# Grasshopper definition Map_From PC to GH.gh (Grasshopper 1.0.7)
# Copyright: Co-de-iT
# plug-ins: Heteroptera, MeshEdit Components, Volvox, Pufferfish, Moonlight, Bifocals, Weaverbird, Starling

# ----
# Beams
number_slider = Slider(-2, range=-10..10)
xy = XYPlane(Origin=Point(0, 0, 0))
prot = RotatePlane(Plane=xy, Angle=degrees(number_slider))
beams = Geometry([<mesh referenced from the Rhino model> x4])
bbox = BoundingBox(Content=beams, Plane=prot)  # -> Box, Box_2
mesh = MeshBrep(
    Brep=bbox.Box,
    Settings={GridMaxCount=0, GridMinCount=16, JaggedSeams=False, MaxEdgeLength=0, MinEdgeLength=0.0001, MinTolerance=0, Refine=True, RefineAngle=0, RelativeTolerance=0.65, SimplePlanes=True, Tolerance=0})

# ---- group: Columns
# Columns
beams_2 = Geometry([<mesh referenced from the Rhino model> x2])

# ----
item = ListItem(List=beams_2, Index=1, Wrap=True)
wbedges = WeaverbirdsMeshEdges(MeshOrPolylines=item)

# ----
# Cool Effect
# Here!
moonlight = Moonlight(Mode=invert(False))

# ---- group: Wall
geo = Geometry(<mesh referenced from the Rhino model>)

# ----
cull = CullPattern(List=wbedges, CullPattern=[True, False])

# ---- group: Ceiling
geo_2 = Geometry([<mesh referenced from the Rhino model> x3])

# ----
# Floor
floor = Geometry(<mesh referenced from the Rhino model>)
bbox_2 = BoundingBox(Content=floor, Plane=prot)  # -> Box, Box_2

split = SplitList(List=cull, Index=Slider(2, range=0..95))  # -> ListA, ListB

bbox_3 = BoundingBox(Content=geo, Plane=prot)  # -> Box, Box_2

# ----
# Ceiling
bbox_4 = BoundingBox(Content=geo_2, Plane=prot)  # -> Box, Box_2

split_2 = SplitList(List=split.ListB, Index=Slider(22, range=0..95))  # -> ListA, ListB
join = JoinCurves(Curves=split_2.ListA, Preserve=False)
clscrv = CloseCurve(Curve=join, CloseType=0, Bulge=0.5, Tolerance=0)  # -> Closed, R

# ----
# Faking the octomap ;)
number_slider_2 = Slider(0.3, range=0..10)
vsub = VoxelSubsampling(Size=number_slider_2)
clo = Cloud(<cloud referenced from the Rhino model>)
bcrop = BoxCrop(Box=<geometry referenced from the Rhino model>)
cloude = CloudEngine(Cloud=clo, Instruction0=vsub, Instruction1=bcrop)  # disabled
xy_2 = XYPlane(Origin=Point(0, 0, 0))
Z = UnitZ(Factor=Slider(-22.443, range=-25..1))
move = Move(Geometry=xy_2, Motion=Z)  # -> Geometry, Transform
voxelc = VoxelColored(Cloud=cloude, VoxelSize=Slider(0.5, range=0..1))
crv = Curve(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)
Y = UnitY(Factor=Slider(10, range=0..10))
demesh = DeconstructMesh(Mesh=voxelc)  # -> Vertices, Faces, Colours, Normals
divide = DivideCurve(Curve=crv, Count=Slider(300, range=0..1000), Kinks=False)  # -> Points, Tangents, Parameters
wbfacepolys = WeaverbirdsFacePolylines(Mesh=voxelc)
project = Project(Geometry=demesh.Vertices, Plane=move.Geometry)  # -> Geometry, Transform
item_2 = ListItem(List=divide.Points, Index=Slider(299, range=30..299), Wrap=True)
move_2 = Move(Geometry=item_2, Motion=Y)  # -> Geometry, Transform
dist = Distance(PointA=demesh.Vertices, PointB=project.Geometry)
preview = CustomPreview(Geometry=wbfacepolys, Material=ColourSwatch(SwatchColor=RGB(0, 0, 0)))
camera = CameraCrane(
    LocationOptional=item_2,
    TargetOptional=move_2.Geometry,
    LensOptional=Slider(29, range=0..100),
    ViewNameOptional="Perspective",
    Size=2,
    ActivationOptional=Toggle(True))  # -> LocationOptional, TargetOptional, LensOptional, UpOptional, FRect, BRect, HorizontalViewAngle, VerticalViewAngle, ScreenRatio
gradient = Gradient(
    LowerLimit=0,
    UpperLimit=Slider(10, range=0..10),
    Parameter=dist,
    stops=[0: RGB(234, 38, 0), 0.25: RGB(234, 126, 0), 0.5: RGB(254, 244, 84), 0.75: RGB(173, 203, 249), 1: RGB(75, 107, 169)])
conmesh = ConstructMesh(Vertices=demesh.Vertices, Faces=demesh.Faces, Colours=gradient)

slstarmesh = SlStarMesh(Polyline=clscrv.Closed)

offmsh = OffsetMesh(Mesh=mesh, Distance=Slider(0, range=-1..0), BothSides=False, CreateSolid=invert(True))  # -> flatten(Offset)
offmsh_2 = OffsetMesh(Mesh=mesh, Distance=Slider(-0.215, range=-1..0), BothSides=False, CreateSolid=invert(True))  # -> flatten(Offset)
f_submqf = SubdivideMeshQuadFace(mesh=offmsh_2, u_steps=Slider(5, range=0..10), v_steps=Slider(20, range=0..20))  # -> point_grid, mesh_2
demesh_2 = DeconstructMesh(Mesh=f_submqf.mesh_2)  # -> Vertices, Faces, Colours, Normals
offmsh_3 = OffsetMesh(Mesh=mesh, Distance=Slider(0.162, range=-1..1), BothSides=False, CreateSolid=invert(True))  # -> flatten(Offset)
msh2psrf = MeshToPolysurface(Mesh=offmsh_3, Triangles=False, FaceMerge=False)
bcrop_2 = BoxCrop(Box=msh2psrf)
clo_2 = Cloud(<cloud referenced from the Rhino model>)
rsub = RandomSubsampling(Percent=Slider(0.1, range=0..1), Seed=123)
cloude_2 = CloudEngine(Cloud=clo_2, Instruction0=bcrop_2, Instruction1=rsub)  # disabled
decloud = DeconstructCloud(Cloud=cloude_2)  # -> Points, Normals, Colors
cps = ClosestPoints(Point=demesh_2.Vertices, Cloud=decloud.Points, Count=Slider(1, range=0..10))  # -> flatten(ClosestPoint), flatten(CPIndex), Distance
item_3 = ListItem(List=decloud.Colors, Index=cps.CPIndex, Wrap=True)
conmesh_2 = ConstructMesh(Vertices=demesh_2.Vertices, Faces=demesh_2.Faces, Colours=item_3)

mesh_2 = MeshBrep(
    Brep=bbox_3.Box,
    Settings={GridMaxCount=0, GridMinCount=16, JaggedSeams=False, MaxEdgeLength=0, MinEdgeLength=0.0001, MinTolerance=0, Refine=True, RefineAngle=0, RelativeTolerance=0.65, SimplePlanes=True, Tolerance=0})
demesh_3 = DeconstructMesh(Mesh=mesh_2)  # -> Vertices, Faces, Colours, Normals
offmsh_4 = OffsetMesh(Mesh=bbox_3.Box, Distance=Slider(1, range=-1..1), BothSides=False, CreateSolid=invert(True))  # -> flatten(Offset)
item_4 = ListItem(List=demesh_3.Faces, Index=0, Wrap=True)
item_5 = ListItem(List=mesh_2, Index=0, Wrap=True)
deface = DeconstructFace(Face=item_4)  # -> CornerA, CornerB, CornerC, CornerD
msh2psrf_2 = MeshToPolysurface(Mesh=offmsh_4, Triangles=False, FaceMerge=False)
item_6 = ListItem(List=demesh_3.Vertices, Index=[deface.CornerA, deface.CornerB, deface.CornerC, deface.CornerD], Wrap=True)
conmesh_3 = ConstructMesh(Vertices=item_6, Faces={A=0, B=1, C=2, D=3})
f_submqf_2 = SubdivideMeshQuadFace_2(mesh=conmesh_3, u_steps=Slider(20, range=0..20), v_steps=Slider(70, range=0..100))  # -> point_grid, mesh_2
demesh_4 = DeconstructMesh(Mesh=f_submqf_2.mesh_2)  # -> Vertices, Faces, Colours, Normals
rsub_2 = RandomSubsampling(Percent=Slider(0.1, range=0..1), Seed=123)
bcrop_3 = BoxCrop(Box=msh2psrf_2)
clo_3 = Cloud(<cloud referenced from the Rhino model>)
cloude_3 = CloudEngine(Cloud=clo_3, Instruction0=bcrop_3, Instruction1=rsub_2)  # disabled
decloud_2 = DeconstructCloud(Cloud=cloude_3)  # -> Points, Normals, Colors
cps_2 = ClosestPoints(Point=demesh_4.Vertices, Cloud=decloud_2.Points, Count=Slider(1, range=0..10))  # -> flatten(ClosestPoint), flatten(CPIndex), Distance
item_7 = ListItem(List=decloud_2.Colors, Index=cps_2.CPIndex, Wrap=True)
conmesh_4 = ConstructMesh(Vertices=demesh_4.Vertices, Faces=demesh_4.Faces, Colours=item_7)

offmsh_5 = OffsetMesh(Mesh=slstarmesh, Distance=Slider(0.3, range=-12..1), BothSides=False, CreateSolid=True)

mesh_3 = MeshBrep(
    Brep=bbox_4.Box,
    Settings={GridMaxCount=0, GridMinCount=16, JaggedSeams=False, MaxEdgeLength=0, MinEdgeLength=0.0001, MinTolerance=0, Refine=True, RefineAngle=0, RelativeTolerance=0.65, SimplePlanes=True, Tolerance=0})
demesh_5 = DeconstructMesh(Mesh=mesh_3)  # -> Vertices, Faces, Colours, Normals
item_8 = ListItem(List=demesh_5.Faces, Index=Slider(4, range=0..10), Wrap=True)
item_9 = ListItem(List=mesh_3, Index=0, Wrap=True)
deface_2 = DeconstructFace(Face=item_8)  # -> CornerA, CornerB, CornerC, CornerD
item_10 = ListItem(List=demesh_5.Vertices, Index=[deface_2.CornerA, deface_2.CornerB, deface_2.CornerC, deface_2.CornerD], Wrap=True)
conmesh_5 = ConstructMesh(Vertices=item_10, Faces={A=0, B=1, C=2, D=3})
f_submqf_3 = SubdivideMeshQuadFace(mesh=conmesh_5, u_steps=Slider(20, range=0..20), v_steps=Slider(50, range=0..50))  # -> point_grid, mesh_2
demesh_6 = DeconstructMesh(Mesh=f_submqf_3.mesh_2)  # -> Vertices, Faces, Colours, Normals
bcrop_4 = BoxCrop(Box=bbox_4.Box)
clo_4 = Cloud(<cloud referenced from the Rhino model>)
vsub_2 = VoxelSubsampling(Size=Slider(0.2, range=0..1))
cloude_4 = CloudEngine(Cloud=clo_4, Instruction0=bcrop_4, Instruction1=vsub_2)  # disabled
panel = Panel(cloude_4)
decloud_3 = DeconstructCloud(Cloud=cloude_4)  # -> Points, Normals, Colors
cps_3 = ClosestPoints(Point=demesh_6.Vertices, Cloud=decloud_3.Points, Count=Slider(1, range=0..10))  # -> flatten(ClosestPoint), flatten(CPIndex), Distance
item_11 = ListItem(List=decloud_3.Colors, Index=cps_3.CPIndex, Wrap=True)
conmesh_6 = ConstructMesh(Vertices=demesh_6.Vertices, Faces=demesh_6.Faces, Colours=item_11)

mesh_4 = MeshBrep(
    Brep=bbox_2.Box,
    Settings={GridMaxCount=0, GridMinCount=16, JaggedSeams=False, MaxEdgeLength=0, MinEdgeLength=0.0001, MinTolerance=0, Refine=True, RefineAngle=0, RelativeTolerance=0.65, SimplePlanes=True, Tolerance=0})
demesh_7 = DeconstructMesh(Mesh=mesh_4)  # -> Vertices, Faces, Colours, Normals
item_12 = ListItem(List=demesh_7.Faces, Index=Slider(5, range=0..10), Wrap=True)
item_13 = ListItem(List=mesh_4, Index=0, Wrap=True)
deface_3 = DeconstructFace(Face=item_12)  # -> CornerA, CornerB, CornerC, CornerD
item_14 = ListItem(List=demesh_7.Vertices, Index=[deface_3.CornerA, deface_3.CornerB, deface_3.CornerC, deface_3.CornerD], Wrap=True)
conmesh_7 = ConstructMesh(Vertices=item_14, Faces={A=0, B=1, C=2, D=3})
f_submqf_4 = SubdivideMeshQuadFace_2(mesh=conmesh_7, u_steps=Slider(50, range=0..50), v_steps=Slider(50, range=0..50))  # -> point_grid, mesh_2
demesh_8 = DeconstructMesh(Mesh=f_submqf_4.mesh_2)  # -> Vertices, Faces, Colours, Normals
bcrop_5 = BoxCrop(Box=bbox_2.Box)
clo_5 = Cloud(<cloud referenced from the Rhino model>)
rsub_3 = RandomSubsampling(Percent=Slider(0.1, range=0..1), Seed=123)
cloude_5 = CloudEngine(Cloud=clo_5, Instruction0=bcrop_5, Instruction1=rsub_3)  # disabled
decloud_4 = DeconstructCloud(Cloud=cloude_5)  # -> Points, Normals, Colors
cps_4 = ClosestPoints(Point=demesh_8.Vertices, Cloud=decloud_4.Points, Count=Slider(1, range=0..10))  # -> flatten(ClosestPoint), flatten(CPIndex), Distance
item_15 = ListItem(List=decloud_4.Colors, Index=cps_4.CPIndex, Wrap=True)
conmesh_8 = ConstructMesh(Vertices=demesh_8.Vertices, Faces=demesh_8.Faces, Colours=item_15)

number_slider_3 = Slider(-0.3, range=-1..1)
explode = MeshExplode(Mesh=offmsh_5, Interpolate=False)
series = Series(Start=number_slider_3, Step=number_slider_3, Count=Slider(35, range=0..100))
split_3 = SplitList(List=explode, Index=Slider(46, range=0..100))  # -> ListA, ListB
Z_2 = UnitZ(Factor=series)
mjoin = MeshJoin(Meshes=split_3.ListB)
move_3 = Move(Geometry=mjoin, Motion=Z_2)  # -> Geometry, Transform
mjoin_2 = MeshJoin(Meshes=[move_3.Geometry, mjoin])
weldvertices = MeshWeldVertices(Mesh=mjoin_2, Tolerance=0.01)  # -> RuntimeMessage, Mesh

xy_3 = XYPlane(Origin=Point(0, 0, 0))
prot_2 = RotatePlane(Plane=xy_3, Angle=degrees(Slider(2, range=-10..10)))
bbox_5 = BoundingBox(Content=beams_2, Plane=prot_2)  # -> Box, Box_2
demesh_9 = DeconstructMesh(Mesh=weldvertices.Mesh)  # -> Vertices, Faces, Colours, Normals
bcrop_6 = BoxCrop(Box=bbox_5.Box)
vsub_3 = VoxelSubsampling(Size=Slider(0.2, range=0..1))
clo_6 = Cloud(<cloud referenced from the Rhino model>)
swatch = ColourSwatch(SwatchColor=RGB(128, 118, 107))
cloude_6 = CloudEngine(Cloud=clo_6, Instruction0=bcrop_6, Instruction1=vsub_3)
decloud_5 = DeconstructCloud(Cloud=cloude_6)  # -> Points, Normals, Colors
conmesh_9 = ConstructMesh(Vertices=demesh_9.Vertices, Faces=demesh_9.Faces, Colours=decloud_5.Colors)  # -> flatten(Mesh)
item_16 = ListItem(List=conmesh_9, Index=-1, Wrap=True)
center = Center(Geometry=item_16)  # -> Center, Dimension
rot3d = Rotate3D(Geometry=item_16, Angle=degrees(Slider(-2, range=-5..1)), Center=center.Center, Axis=Vector(1, 0, 0))  # -> Geometry, Transform
X = UnitX(Factor=Slider(12.2, range=0..15))
X_2 = UnitX(Factor=Slider(-12.1, range=-20..15))
X_3 = UnitX(Factor=Slider(-24.2, range=-30..15))
move_4 = Move(Geometry=rot3d.Geometry, Motion=[X, X_2, X_3])  # -> Geometry, Transform
mesh_5 = Mesh([move_4.Geometry, rot3d.Geometry])

# ----
# Beams
number_slider_4 = Slider(-2, range=-10..10)
xy_4 = XYPlane(Origin=Point(0, 0, 0))
prot_3 = RotatePlane(Plane=xy_4, Angle=degrees(number_slider_4))
beams_3 = Geometry([<mesh referenced from the Rhino model> x4])
bbox_6 = BoundingBox(Content=beams_3, Plane=prot_3)  # -> Box, Box_2
mesh_6 = MeshBrep(
    Brep=bbox_6.Box,
    Settings={GridMaxCount=0, GridMinCount=16, JaggedSeams=False, MaxEdgeLength=0, MinEdgeLength=0.0001, MinTolerance=0, Refine=True, RefineAngle=0, RelativeTolerance=0.65, SimplePlanes=True, Tolerance=0})

# ---- group: Columns
# Columns
beams_4 = Geometry([<mesh referenced from the Rhino model> x2])

# ---- group: Ceiling
geo_3 = Geometry([<mesh referenced from the Rhino model> x3])

# ----
# Floor
floor_2 = Geometry(<mesh referenced from the Rhino model>)
bbox_7 = BoundingBox(Content=floor_2, Plane=prot)  # -> Box, Box_2

# ---- group: Wall
geo_4 = Geometry(<mesh referenced from the Rhino model>)

# ----
item_17 = ListItem(List=beams_4, Index=1, Wrap=True)
wbedges_2 = WeaverbirdsMeshEdges(MeshOrPolylines=item_17)

# ----
# Ceiling
bbox_8 = BoundingBox(Content=geo_3, Plane=prot)  # -> Box, Box_2

# ----
# Wall
bbox_9 = BoundingBox(Content=geo_4, Plane=prot)  # -> Box, Box_2

cull_2 = CullPattern(List=wbedges_2, CullPattern=[True, False])
split_4 = SplitList(List=cull_2, Index=Slider(2, range=0..95))  # -> ListA, ListB
split_5 = SplitList(List=split_4.ListB, Index=Slider(22, range=0..95))  # -> ListA, ListB
join_2 = JoinCurves(Curves=split_5.ListA, Preserve=False)

mesh_7 = MeshBrep(
    Brep=bbox_9.Box,
    Settings={GridMaxCount=0, GridMinCount=16, JaggedSeams=False, MaxEdgeLength=0, MinEdgeLength=0.0001, MinTolerance=0, Refine=True, RefineAngle=0, RelativeTolerance=0.65, SimplePlanes=True, Tolerance=0})
demesh_10 = DeconstructMesh(Mesh=mesh_7)  # -> Vertices, Faces, Colours, Normals
offmsh_6 = OffsetMesh(Mesh=bbox_9.Box, Distance=Slider(1, range=-1..1), BothSides=False, CreateSolid=invert(True))  # -> flatten(Offset)
item_18 = ListItem(List=demesh_10.Faces, Index=0, Wrap=True)
item_19 = ListItem(List=mesh_7, Index=0, Wrap=True)
deface_4 = DeconstructFace(Face=item_18)  # -> CornerA, CornerB, CornerC, CornerD
msh2psrf_3 = MeshToPolysurface(Mesh=offmsh_6, Triangles=False, FaceMerge=False)
item_20 = ListItem(List=demesh_10.Vertices, Index=[deface_4.CornerA, deface_4.CornerB, deface_4.CornerC, deface_4.CornerD], Wrap=True)
conmesh_10 = ConstructMesh(Vertices=item_20, Faces={A=0, B=1, C=2, D=3})
f_submqf_5 = SubdivideMeshQuadFace_2(mesh=conmesh_10, u_steps=Slider(20, range=0..20), v_steps=Slider(70, range=0..100))  # -> point_grid, mesh_2
demesh_11 = DeconstructMesh(Mesh=f_submqf_5.mesh_2)  # -> Vertices, Faces, Colours, Normals
rsub_4 = RandomSubsampling(Percent=Slider(0.1, range=0..1), Seed=123)
bcrop_7 = BoxCrop(Box=msh2psrf_3)
clo_7 = Cloud(<cloud referenced from the Rhino model>)
cloude_7 = CloudEngine(Cloud=clo_7, Instruction0=bcrop_7, Instruction1=rsub_4)
decloud_6 = DeconstructCloud(Cloud=cloude_7)  # -> Points, Normals, Colors
cps_5 = ClosestPoints(Point=demesh_11.Vertices, Cloud=decloud_6.Points, Count=Slider(1, range=0..10))  # -> flatten(ClosestPoint), flatten(CPIndex), Distance
item_21 = ListItem(List=decloud_6.Colors, Index=cps_5.CPIndex, Wrap=True)
conmesh_11 = ConstructMesh(Vertices=demesh_11.Vertices, Faces=demesh_11.Faces, Colours=item_21)

clscrv_2 = CloseCurve(Curve=join_2, CloseType=0, Bulge=0.5, Tolerance=0)  # -> Closed, R

mesh_8 = MeshBrep(
    Brep=bbox_8.Box,
    Settings={GridMaxCount=0, GridMinCount=16, JaggedSeams=False, MaxEdgeLength=0, MinEdgeLength=0.0001, MinTolerance=0, Refine=True, RefineAngle=0, RelativeTolerance=0.65, SimplePlanes=True, Tolerance=0})
demesh_12 = DeconstructMesh(Mesh=mesh_8)  # -> Vertices, Faces, Colours, Normals
item_22 = ListItem(List=demesh_12.Faces, Index=Slider(4, range=0..10), Wrap=True)
item_23 = ListItem(List=mesh_8, Index=0, Wrap=True)
deface_5 = DeconstructFace(Face=item_22)  # -> CornerA, CornerB, CornerC, CornerD
item_24 = ListItem(List=demesh_12.Vertices, Index=[deface_5.CornerA, deface_5.CornerB, deface_5.CornerC, deface_5.CornerD], Wrap=True)
conmesh_12 = ConstructMesh(Vertices=item_24, Faces={A=0, B=1, C=2, D=3})
f_submqf_6 = SubdivideMeshQuadFace(mesh=conmesh_12, u_steps=Slider(20, range=0..20), v_steps=Slider(50, range=0..50))  # -> point_grid, mesh_2
demesh_13 = DeconstructMesh(Mesh=f_submqf_6.mesh_2)  # -> Vertices, Faces, Colours, Normals
bcrop_8 = BoxCrop(Box=bbox_8.Box)
clo_8 = Cloud(<cloud referenced from the Rhino model>)
vsub_4 = VoxelSubsampling(Size=Slider(0.2, range=0..1))
cloude_8 = CloudEngine(Cloud=clo_8, Instruction0=bcrop_8, Instruction1=vsub_4)
panel_2 = Panel(cloude_8)
decloud_7 = DeconstructCloud(Cloud=cloude_8)  # -> Points, Normals, Colors
cps_6 = ClosestPoints(Point=demesh_13.Vertices, Cloud=decloud_7.Points, Count=Slider(1, range=0..10))  # -> flatten(ClosestPoint), flatten(CPIndex), Distance
item_25 = ListItem(List=decloud_7.Colors, Index=cps_6.CPIndex, Wrap=True)
conmesh_13 = ConstructMesh(Vertices=demesh_13.Vertices, Faces=demesh_13.Faces, Colours=item_25)

mesh_9 = MeshBrep(
    Brep=bbox_7.Box,
    Settings={GridMaxCount=0, GridMinCount=16, JaggedSeams=False, MaxEdgeLength=0, MinEdgeLength=0.0001, MinTolerance=0, Refine=True, RefineAngle=0, RelativeTolerance=0.65, SimplePlanes=True, Tolerance=0})
demesh_14 = DeconstructMesh(Mesh=mesh_9)  # -> Vertices, Faces, Colours, Normals
item_26 = ListItem(List=demesh_14.Faces, Index=Slider(5, range=0..10), Wrap=True)
item_27 = ListItem(List=mesh_9, Index=0, Wrap=True)
deface_6 = DeconstructFace(Face=item_26)  # -> CornerA, CornerB, CornerC, CornerD
item_28 = ListItem(List=demesh_14.Vertices, Index=[deface_6.CornerA, deface_6.CornerB, deface_6.CornerC, deface_6.CornerD], Wrap=True)
conmesh_14 = ConstructMesh(Vertices=item_28, Faces={A=0, B=1, C=2, D=3})
f_submqf_7 = SubdivideMeshQuadFace_2(mesh=conmesh_14, u_steps=Slider(50, range=0..50), v_steps=Slider(50, range=0..50))  # -> point_grid, mesh_2
demesh_15 = DeconstructMesh(Mesh=f_submqf_7.mesh_2)  # -> Vertices, Faces, Colours, Normals
bcrop_9 = BoxCrop(Box=bbox_7.Box)
clo_9 = Cloud(<cloud referenced from the Rhino model>)
rsub_5 = RandomSubsampling(Percent=Slider(0.1, range=0..1), Seed=123)
cloude_9 = CloudEngine(Cloud=clo_9, Instruction0=bcrop_9, Instruction1=rsub_5)
decloud_8 = DeconstructCloud(Cloud=cloude_9)  # -> Points, Normals, Colors
cps_7 = ClosestPoints(Point=demesh_15.Vertices, Cloud=decloud_8.Points, Count=Slider(1, range=0..10))  # -> flatten(ClosestPoint), flatten(CPIndex), Distance
item_29 = ListItem(List=decloud_8.Colors, Index=cps_7.CPIndex, Wrap=True)
conmesh_15 = ConstructMesh(Vertices=demesh_15.Vertices, Faces=demesh_15.Faces, Colours=item_29)

slstarmesh_2 = SlStarMesh(Polyline=clscrv_2.Closed)

offmsh_7 = OffsetMesh(Mesh=mesh_6, Distance=Slider(0, range=-1..0), BothSides=False, CreateSolid=invert(True))  # -> flatten(Offset)
offmsh_8 = OffsetMesh(Mesh=mesh_6, Distance=Slider(-0.215, range=-1..0), BothSides=False, CreateSolid=invert(True))  # -> flatten(Offset)
f_submqf_8 = SubdivideMeshQuadFace(mesh=offmsh_8, u_steps=Slider(5, range=0..10), v_steps=Slider(20, range=0..20))  # -> point_grid, mesh_2
demesh_16 = DeconstructMesh(Mesh=f_submqf_8.mesh_2)  # -> Vertices, Faces, Colours, Normals
offmsh_9 = OffsetMesh(Mesh=mesh_6, Distance=Slider(0.162, range=-1..1), BothSides=False, CreateSolid=invert(True))  # -> flatten(Offset)
msh2psrf_4 = MeshToPolysurface(Mesh=offmsh_9, Triangles=False, FaceMerge=False)
bcrop_10 = BoxCrop(Box=msh2psrf_4)
clo_10 = Cloud(<cloud referenced from the Rhino model>)
rsub_6 = RandomSubsampling(Percent=Slider(0.1, range=0..1), Seed=123)
cloude_10 = CloudEngine(Cloud=clo_10, Instruction0=bcrop_10, Instruction1=rsub_6)
decloud_9 = DeconstructCloud(Cloud=cloude_10)  # -> Points, Normals, Colors
cps_8 = ClosestPoints(Point=demesh_16.Vertices, Cloud=decloud_9.Points, Count=Slider(1, range=0..10))  # -> flatten(ClosestPoint), flatten(CPIndex), Distance
item_30 = ListItem(List=decloud_9.Colors, Index=cps_8.CPIndex, Wrap=True)
conmesh_16 = ConstructMesh(Vertices=demesh_16.Vertices, Faces=demesh_16.Faces, Colours=item_30)

offmsh_10 = OffsetMesh(Mesh=slstarmesh_2, Distance=Slider(0.3, range=-12..1), BothSides=False, CreateSolid=True)
number_slider_5 = Slider(-0.3, range=-1..1)
explode_2 = MeshExplode(Mesh=offmsh_10, Interpolate=False)
series_2 = Series(Start=number_slider_5, Step=number_slider_5, Count=Slider(35, range=0..100))
split_6 = SplitList(List=explode_2, Index=Slider(46, range=0..100))  # -> ListA, ListB
Z_3 = UnitZ(Factor=series_2)
mjoin_3 = MeshJoin(Meshes=split_6.ListB)
move_5 = Move(Geometry=mjoin_3, Motion=Z_3)  # -> Geometry, Transform
mjoin_4 = MeshJoin(Meshes=[move_5.Geometry, mjoin_3])
weldvertices_2 = MeshWeldVertices(Mesh=mjoin_4, Tolerance=0.01)  # -> RuntimeMessage, Mesh

xy_5 = XYPlane(Origin=Point(0, 0, 0))
prot_4 = RotatePlane(Plane=xy_5, Angle=degrees(Slider(2, range=-10..10)))
bbox_10 = BoundingBox(Content=beams_4, Plane=prot_4)  # -> Box, Box_2
demesh_17 = DeconstructMesh(Mesh=weldvertices_2.Mesh)  # -> Vertices, Faces, Colours, Normals
bcrop_11 = BoxCrop(Box=bbox_10.Box)
vsub_5 = VoxelSubsampling(Size=Slider(0.2, range=0..1))
clo_11 = Cloud(<cloud referenced from the Rhino model>)
swatch_2 = ColourSwatch(SwatchColor=RGB(128, 118, 107))
cloude_11 = CloudEngine(Cloud=clo_11, Instruction0=bcrop_11, Instruction1=vsub_5)
decloud_10 = DeconstructCloud(Cloud=cloude_11)  # -> Points, Normals, Colors
conmesh_17 = ConstructMesh(Vertices=demesh_17.Vertices, Faces=demesh_17.Faces, Colours=decloud_10.Colors)  # -> flatten(Mesh)
item_31 = ListItem(List=conmesh_17, Index=-1, Wrap=True)
center_2 = Center(Geometry=item_31)  # -> Center, Dimension
rot3d_2 = Rotate3D(Geometry=item_31, Angle=degrees(Slider(-2, range=-5..1)), Center=center_2.Center, Axis=Vector(1, 0, 0))  # -> Geometry, Transform
X_4 = UnitX(Factor=Slider(12.2, range=0..15))
X_5 = UnitX(Factor=Slider(-12.1, range=-20..15))
X_6 = UnitX(Factor=Slider(-24.2, range=-30..15))
move_6 = Move(Geometry=rot3d_2.Geometry, Motion=[X_4, X_5, X_6])  # -> Geometry, Transform
mesh_10 = Mesh([move_6.Geometry, rot3d_2.Geometry])

# ----
# Beams
number_slider_6 = Slider(-2, range=-10..10)
xy_6 = XYPlane(Origin=Point(0, 0, 0))
prot_5 = RotatePlane(Plane=xy_6, Angle=degrees(number_slider_6))
beams_5 = Geometry([<mesh referenced from the Rhino model> x4])
bbox_11 = BoundingBox(Content=beams_5, Plane=prot_5)  # -> Box, Box_2
mesh_11 = MeshBrep(
    Brep=bbox_11.Box,
    Settings={GridMaxCount=0, GridMinCount=16, JaggedSeams=False, MaxEdgeLength=0, MinEdgeLength=0.0001, MinTolerance=0, Refine=True, RefineAngle=0, RelativeTolerance=0.65, SimplePlanes=True, Tolerance=0})

# ---- group: Columns
# Columns
beams_6 = Geometry([<mesh referenced from the Rhino model> x2])

# ---- group: Ceiling
geo_5 = Geometry([<mesh referenced from the Rhino model> x3])

# ----
# Floor
floor_3 = Geometry(<mesh referenced from the Rhino model>)
bbox_12 = BoundingBox(Content=floor_3, Plane=prot)  # -> Box, Box_2

# ---- group: Wall
geo_6 = Geometry(<mesh referenced from the Rhino model>)

# ----
item_32 = ListItem(List=beams_6, Index=1, Wrap=True)
wbedges_3 = WeaverbirdsMeshEdges(MeshOrPolylines=item_32)

# ----
# Ceiling
bbox_13 = BoundingBox(Content=geo_5, Plane=prot)  # -> Box, Box_2

# ----
# Wall
bbox_14 = BoundingBox(Content=geo_6, Plane=prot)  # -> Box, Box_2

cull_3 = CullPattern(List=wbedges_3, CullPattern=[True, False])
split_7 = SplitList(List=cull_3, Index=Slider(2, range=0..95))  # -> ListA, ListB
split_8 = SplitList(List=split_7.ListB, Index=Slider(22, range=0..95))  # -> ListA, ListB
join_3 = JoinCurves(Curves=split_8.ListA, Preserve=False)

mesh_12 = MeshBrep(
    Brep=bbox_14.Box,
    Settings={GridMaxCount=0, GridMinCount=16, JaggedSeams=False, MaxEdgeLength=0, MinEdgeLength=0.0001, MinTolerance=0, Refine=True, RefineAngle=0, RelativeTolerance=0.65, SimplePlanes=True, Tolerance=0})
demesh_18 = DeconstructMesh(Mesh=mesh_12)  # -> Vertices, Faces, Colours, Normals
offmsh_11 = OffsetMesh(Mesh=bbox_14.Box, Distance=Slider(1, range=-1..1), BothSides=False, CreateSolid=invert(True))  # -> flatten(Offset)
item_33 = ListItem(List=demesh_18.Faces, Index=0, Wrap=True)
item_34 = ListItem(List=mesh_12, Index=0, Wrap=True)
deface_7 = DeconstructFace(Face=item_33)  # -> CornerA, CornerB, CornerC, CornerD
msh2psrf_5 = MeshToPolysurface(Mesh=offmsh_11, Triangles=False, FaceMerge=False)
item_35 = ListItem(List=demesh_18.Vertices, Index=[deface_7.CornerA, deface_7.CornerB, deface_7.CornerC, deface_7.CornerD], Wrap=True)
conmesh_18 = ConstructMesh(Vertices=item_35, Faces={A=0, B=1, C=2, D=3})
f_submqf_9 = SubdivideMeshQuadFace_2(mesh=conmesh_18, u_steps=Slider(20, range=0..20), v_steps=Slider(70, range=0..100))  # -> point_grid, mesh_2
demesh_19 = DeconstructMesh(Mesh=f_submqf_9.mesh_2)  # -> Vertices, Faces, Colours, Normals
rsub_7 = RandomSubsampling(Percent=Slider(0.1, range=0..1), Seed=123)
bcrop_12 = BoxCrop(Box=msh2psrf_5)
clo_12 = Cloud(<cloud referenced from the Rhino model>)
cloude_12 = CloudEngine(Cloud=clo_12, Instruction0=bcrop_12, Instruction1=rsub_7)
decloud_11 = DeconstructCloud(Cloud=cloude_12)  # -> Points, Normals, Colors
cps_9 = ClosestPoints(Point=demesh_19.Vertices, Cloud=decloud_11.Points, Count=Slider(1, range=0..10))  # -> flatten(ClosestPoint), flatten(CPIndex), Distance
item_36 = ListItem(List=decloud_11.Colors, Index=cps_9.CPIndex, Wrap=True)
conmesh_19 = ConstructMesh(Vertices=demesh_19.Vertices, Faces=demesh_19.Faces, Colours=item_36)

clscrv_3 = CloseCurve(Curve=join_3, CloseType=0, Bulge=0.5, Tolerance=0)  # -> Closed, R

mesh_13 = MeshBrep(
    Brep=bbox_13.Box,
    Settings={GridMaxCount=0, GridMinCount=16, JaggedSeams=False, MaxEdgeLength=0, MinEdgeLength=0.0001, MinTolerance=0, Refine=True, RefineAngle=0, RelativeTolerance=0.65, SimplePlanes=True, Tolerance=0})
demesh_20 = DeconstructMesh(Mesh=mesh_13)  # -> Vertices, Faces, Colours, Normals
item_37 = ListItem(List=demesh_20.Faces, Index=Slider(4, range=0..10), Wrap=True)
item_38 = ListItem(List=mesh_13, Index=0, Wrap=True)
deface_8 = DeconstructFace(Face=item_37)  # -> CornerA, CornerB, CornerC, CornerD
item_39 = ListItem(List=demesh_20.Vertices, Index=[deface_8.CornerA, deface_8.CornerB, deface_8.CornerC, deface_8.CornerD], Wrap=True)
conmesh_20 = ConstructMesh(Vertices=item_39, Faces={A=0, B=1, C=2, D=3})
f_submqf_10 = SubdivideMeshQuadFace(mesh=conmesh_20, u_steps=Slider(20, range=0..20), v_steps=Slider(50, range=0..50))  # -> point_grid, mesh_2
demesh_21 = DeconstructMesh(Mesh=f_submqf_10.mesh_2)  # -> Vertices, Faces, Colours, Normals
bcrop_13 = BoxCrop(Box=bbox_13.Box)
clo_13 = Cloud(<cloud referenced from the Rhino model>)
vsub_6 = VoxelSubsampling(Size=Slider(0.2, range=0..1))
cloude_13 = CloudEngine(Cloud=clo_13, Instruction0=bcrop_13, Instruction1=vsub_6)
panel_3 = Panel(cloude_13)
decloud_12 = DeconstructCloud(Cloud=cloude_13)  # -> Points, Normals, Colors
cps_10 = ClosestPoints(Point=demesh_21.Vertices, Cloud=decloud_12.Points, Count=Slider(1, range=0..10))  # -> flatten(ClosestPoint), flatten(CPIndex), Distance
item_40 = ListItem(List=decloud_12.Colors, Index=cps_10.CPIndex, Wrap=True)
conmesh_21 = ConstructMesh(Vertices=demesh_21.Vertices, Faces=demesh_21.Faces, Colours=item_40)

mesh_14 = MeshBrep(
    Brep=bbox_12.Box,
    Settings={GridMaxCount=0, GridMinCount=16, JaggedSeams=False, MaxEdgeLength=0, MinEdgeLength=0.0001, MinTolerance=0, Refine=True, RefineAngle=0, RelativeTolerance=0.65, SimplePlanes=True, Tolerance=0})
demesh_22 = DeconstructMesh(Mesh=mesh_14)  # -> Vertices, Faces, Colours, Normals
item_41 = ListItem(List=demesh_22.Faces, Index=Slider(5, range=0..10), Wrap=True)
item_42 = ListItem(List=mesh_14, Index=0, Wrap=True)
deface_9 = DeconstructFace(Face=item_41)  # -> CornerA, CornerB, CornerC, CornerD
item_43 = ListItem(List=demesh_22.Vertices, Index=[deface_9.CornerA, deface_9.CornerB, deface_9.CornerC, deface_9.CornerD], Wrap=True)
conmesh_22 = ConstructMesh(Vertices=item_43, Faces={A=0, B=1, C=2, D=3})
f_submqf_11 = SubdivideMeshQuadFace_2(mesh=conmesh_22, u_steps=Slider(50, range=0..50), v_steps=Slider(50, range=0..50))  # -> point_grid, mesh_2
demesh_23 = DeconstructMesh(Mesh=f_submqf_11.mesh_2)  # -> Vertices, Faces, Colours, Normals
bcrop_14 = BoxCrop(Box=bbox_12.Box)
clo_14 = Cloud(<cloud referenced from the Rhino model>)
rsub_8 = RandomSubsampling(Percent=Slider(0.1, range=0..1), Seed=123)
cloude_14 = CloudEngine(Cloud=clo_14, Instruction0=bcrop_14, Instruction1=rsub_8)
decloud_13 = DeconstructCloud(Cloud=cloude_14)  # -> Points, Normals, Colors
cps_11 = ClosestPoints(Point=demesh_23.Vertices, Cloud=decloud_13.Points, Count=Slider(1, range=0..10))  # -> flatten(ClosestPoint), flatten(CPIndex), Distance
item_44 = ListItem(List=decloud_13.Colors, Index=cps_11.CPIndex, Wrap=True)
conmesh_23 = ConstructMesh(Vertices=demesh_23.Vertices, Faces=demesh_23.Faces, Colours=item_44)

slstarmesh_3 = SlStarMesh(Polyline=clscrv_3.Closed)

offmsh_12 = OffsetMesh(Mesh=mesh_11, Distance=Slider(0, range=-1..0), BothSides=False, CreateSolid=invert(True))  # -> flatten(Offset)
offmsh_13 = OffsetMesh(Mesh=mesh_11, Distance=Slider(-0.215, range=-1..0), BothSides=False, CreateSolid=invert(True))  # -> flatten(Offset)
f_submqf_12 = SubdivideMeshQuadFace(mesh=offmsh_13, u_steps=Slider(5, range=0..10), v_steps=Slider(20, range=0..20))  # -> point_grid, mesh_2
demesh_24 = DeconstructMesh(Mesh=f_submqf_12.mesh_2)  # -> Vertices, Faces, Colours, Normals
offmsh_14 = OffsetMesh(Mesh=mesh_11, Distance=Slider(0.162, range=-1..1), BothSides=False, CreateSolid=invert(True))  # -> flatten(Offset)
msh2psrf_6 = MeshToPolysurface(Mesh=offmsh_14, Triangles=False, FaceMerge=False)
clo_15 = Cloud(<cloud referenced from the Rhino model>)
bcrop_15 = BoxCrop(Box=msh2psrf_6)
rsub_9 = RandomSubsampling(Percent=Slider(0.1, range=0..1), Seed=123)
cloude_15 = CloudEngine(Cloud=clo_15, Instruction0=bcrop_15, Instruction1=rsub_9)
decloud_14 = DeconstructCloud(Cloud=cloude_15)  # -> Points, Normals, Colors
cps_12 = ClosestPoints(Point=demesh_24.Vertices, Cloud=decloud_14.Points, Count=Slider(1, range=0..10))  # -> flatten(ClosestPoint), flatten(CPIndex), Distance
item_45 = ListItem(List=decloud_14.Colors, Index=cps_12.CPIndex, Wrap=True)
conmesh_24 = ConstructMesh(Vertices=demesh_24.Vertices, Faces=demesh_24.Faces, Colours=item_45)

offmsh_15 = OffsetMesh(Mesh=slstarmesh_3, Distance=Slider(0.3, range=-12..1), BothSides=False, CreateSolid=True)
number_slider_7 = Slider(-0.3, range=-1..1)
explode_3 = MeshExplode(Mesh=offmsh_15, Interpolate=False)
series_3 = Series(Start=number_slider_7, Step=number_slider_7, Count=Slider(35, range=0..100))
split_9 = SplitList(List=explode_3, Index=Slider(46, range=0..100))  # -> ListA, ListB
Z_4 = UnitZ(Factor=series_3)
mjoin_5 = MeshJoin(Meshes=split_9.ListB)
move_7 = Move(Geometry=mjoin_5, Motion=Z_4)  # -> Geometry, Transform
mjoin_6 = MeshJoin(Meshes=[move_7.Geometry, mjoin_5])
weldvertices_3 = MeshWeldVertices(Mesh=mjoin_6, Tolerance=0.01)  # -> RuntimeMessage, Mesh

xy_7 = XYPlane(Origin=Point(0, 0, 0))
prot_6 = RotatePlane(Plane=xy_7, Angle=degrees(Slider(2, range=-10..10)))
bbox_15 = BoundingBox(Content=beams_6, Plane=prot_6)  # -> Box, Box_2
demesh_25 = DeconstructMesh(Mesh=weldvertices_3.Mesh)  # -> Vertices, Faces, Colours, Normals
bcrop_16 = BoxCrop(Box=bbox_15.Box)
vsub_7 = VoxelSubsampling(Size=Slider(0.2, range=0..1))
clo_16 = Cloud(<cloud referenced from the Rhino model>)
swatch_3 = ColourSwatch(SwatchColor=RGB(128, 118, 107))
cloude_16 = CloudEngine(Cloud=clo_16, Instruction0=bcrop_16, Instruction1=vsub_7)
decloud_15 = DeconstructCloud(Cloud=cloude_16)  # -> Points, Normals, Colors
conmesh_25 = ConstructMesh(Vertices=demesh_25.Vertices, Faces=demesh_25.Faces, Colours=decloud_15.Colors)  # -> flatten(Mesh)
item_46 = ListItem(List=conmesh_25, Index=-1, Wrap=True)
center_3 = Center(Geometry=item_46)  # -> Center, Dimension
rot3d_3 = Rotate3D(Geometry=item_46, Angle=degrees(Slider(-2, range=-5..1)), Center=center_3.Center, Axis=Vector(1, 0, 0))  # -> Geometry, Transform
X_7 = UnitX(Factor=Slider(12.2, range=0..15))
X_8 = UnitX(Factor=Slider(-12.1, range=-20..15))
X_9 = UnitX(Factor=Slider(-24.2, range=-30..15))
move_8 = Move(Geometry=rot3d_3.Geometry, Motion=[X_7, X_8, X_9])  # -> Geometry, Transform
mesh_15 = Mesh([move_8.Geometry, rot3d_3.Geometry])

# ==== cluster SubdivideMeshQuadFace: Subdivides a mesh face in a custom UV number of sub-faces
mesh = ClusterInput()  # Mesh Quad face(s) to subdivide
v_steps = ClusterInput()  # number of steps in V direction
u_steps = ClusterInput()  # number of steps in U direction
wbjoin = WeaverbirdsJoinMeshesAndWeld(Mesh=mesh, Weld=True)
explode = MeshExplode(Mesh=wbjoin, Interpolate=False)  # -> graft(Faces)
lng = ListLength(List=flatten(explode))
equals = Equality(FirstNumber=lng, SecondNumber=1)  # -> Equality, Inequality
demesh = DeconstructMesh(Mesh=explode)  # -> Vertices, Faces, Colours, Normals
item = ListItem(List=demesh.Vertices, Index=0, Wrap=True)  # -> Item, Item1, Item2, Item3
# froGH - a sparse collection of (in)utilities for Grasshopper
# 
#     froGH by Co-de-iT is licensed under a Creative Commons Attribution 4.0 International License.
#     http://creativecommons.org/licenses/by/4.0/
range = Range(Domain=Domain(0, 1), Steps=v_steps)
range_2 = Range(Domain=Domain(0, 1), Steps=u_steps)
merge = Merge(Data1=graft(item.Item), Data2=graft(item.Item1))  # -> simplify(Result)
merge_2 = Merge(Data1=graft(item.Item3), Data2=graft(item.Item2))  # -> simplify(Result)
interp = InterpolateData(Data=merge, Parameter=range_2, Interpolation=2)
interp_2 = InterpolateData(Data=merge_2, Parameter=range_2, Interpolation=2)
merge_3 = Merge(Data1=graft(interp), Data2=graft(interp_2))  # -> simplify(Result)
interp_3 = InterpolateData(Data=merge_3, Parameter=range, Interpolation=2)
match = MatchTree(Tree=interp_3, Guide=merge_3)
pshift = ShiftPaths(Data=match, Offset=-1)
filter = StreamFilter(Gate=equals.Equality, Stream0=pshift, Stream1=flatten(interp_3))
frompoints = MeshFromPoints(Points=filter, UDirection=expr("x+1", u_steps), VDirection=expr("x+1", v_steps))
wbjoin_2 = WeaverbirdsJoinMeshesAndWeld(Mesh=flatten(frompoints), Weld=True)
point_grid = ClusterOutput(filter)  # The grid of subdivided vertices
mesh_2 = ClusterOutput(wbjoin_2)  # The subdivided Mesh

# ==== cluster SubdivideMeshQuadFace_2: Subdivides a mesh face in a custom UV number of sub-faces
mesh = ClusterInput()  # Mesh Quad face(s) to subdivide
v_steps = ClusterInput()  # number of steps in V direction
u_steps = ClusterInput()  # number of steps in U direction
wbjoin = WeaverbirdsJoinMeshesAndWeld(Mesh=mesh, Weld=True)
explode = MeshExplode(Mesh=wbjoin, Interpolate=False)  # -> graft(Faces)
lng = ListLength(List=flatten(explode))
equals = Equality(FirstNumber=lng, SecondNumber=1)  # -> Equality, Inequality
demesh = DeconstructMesh(Mesh=explode)  # -> Vertices, Faces, Colours, Normals
item = ListItem(List=demesh.Vertices, Index=0, Wrap=True)  # -> Item, Item1, Item2, Item3
range = Range(Domain=Domain(0, 1), Steps=v_steps)
range_2 = Range(Domain=Domain(0, 1), Steps=u_steps)
merge = Merge(Data1=graft(item.Item), Data2=graft(item.Item1))  # -> simplify(Result)
merge_2 = Merge(Data1=graft(item.Item3), Data2=graft(item.Item2))  # -> simplify(Result)
interp = InterpolateData(Data=merge, Parameter=range_2, Interpolation=2)
interp_2 = InterpolateData(Data=merge_2, Parameter=range_2, Interpolation=2)
merge_3 = Merge(Data1=graft(interp), Data2=graft(interp_2))  # -> simplify(Result)
interp_3 = InterpolateData(Data=merge_3, Parameter=range, Interpolation=2)
match = MatchTree(Tree=interp_3, Guide=merge_3)
pshift = ShiftPaths(Data=match, Offset=-1)
filter = StreamFilter(Gate=equals.Equality, Stream0=pshift, Stream1=flatten(interp_3))
frompoints = MeshFromPoints(Points=filter, UDirection=expr("x+1", u_steps), VDirection=expr("x+1", v_steps))
wbjoin_2 = WeaverbirdsJoinMeshesAndWeld(Mesh=flatten(frompoints), Weld=True)
point_grid = ClusterOutput(filter)  # The grid of subdivided vertices
mesh_2 = ClusterOutput(wbjoin_2)  # The subdivided Mesh
