# Grasshopper definition Map_Points_of_interest.gh (Grasshopper 1.0.7)
# plug-ins: Heteroptera, MeshEdit Components, Pufferfish, Firefly.X, Topologizer, Human, Parakeet, Weaverbird, Mesh Pipe, Wombat, Relative Neighborhood, Shortest Walk in Gh

number_slider = Slider(1, range=0..7)

# ---- group: Updated
panel = Panel("""1
0
3
2
4
5
6
7""")
mesh = Mesh([<mesh referenced from the Rhino model> x8])
sort = SortList(Keys=panel, ValuesA=mesh)  # -> Keys, ValuesA
item = ListItem(List=sort.ValuesA, Index=number_slider, Wrap=True)

# ----
f_mvneighf = VertexNeighbourFaces(M=item)  # -> nF; inputs M: tree of Mesh
# ---------- f_mvneighf: C# ----------
                /*
    froGH - a sparse collection of (in)utilities for Grasshopper

    Mesh Face Neighbor search - Tree Safe

    code by Alessio Erioli

    This component generates a map of neighbour faces for each vertex
    Works with a single mesh, a list or a tree of meshes

    froGH by Co-de-iT is licensed under a Creative Commons Attribution 4.0 International License.
    http://creativecommons.org/licenses/by/4.0/

    */
    initComp();



    DataTree <int> neighbors = new DataTree<int>();
    Mesh m1;
    GH_Path p;
    int [] neighFaces;
    int[] indArr;
    for (int j = 0; j < M.BranchCount; j++){
      for (int k = 0; k < M.Branch(j).Count; k++){
        m1 = M[M.Paths[j], k];
        for (int i = 0; i < m1.Vertices.Count; i++){
          indArr = M.Paths[j].Indices;
          Array.Resize(ref indArr, indArr.Length + 2);
          indArr[indArr.Length - 2] = k;
          indArr[indArr.Length - 1] = i;
          p = new GH_Path(indArr);
          neighFaces = m1.Vertices.GetVertexFaces(i);
          neighbors.AddRange(neighFaces, p);
        }
      }
    }
    neighbors.SimplifyPaths();
    nF = neighbors;
# ---------- f_mvneighf: C# additional code ----------
  void initComp(){

    Component.Name = "Vertex Neighbour Faces";
    Component.NickName = "f_MVNeighF";
    Component.Description = "generates map of neighbour faces for each vertex";
    Component.Params.Input[0].Name = "Mesh";
    Component.Params.Input[0].Description = "Input Mesh(es)";
    Component.Params.Output[0].Name = "neighbour faces indexes";
    Component.Params.Output[0].Description = "indexes of neighbour faces for each vertex";
  }
# ---------- end f_mvneighf ----------

# ---- group: Bricks
swatch = ColourSwatch(SwatchColor=RGB(191, 0, 0))

# ---- group: Metal
swatch_2 = ColourSwatch(SwatchColor=RGB(5, 204, 2))

# ---- group: Concrete
swatch_3 = ColourSwatch(SwatchColor=RGB(0, 25, 214))

# ---- group: Wood
swatch_4 = ColourSwatch(SwatchColor=RGB(222, 211, 0))

# ---- group: Others
swatch_5 = ColourSwatch(SwatchColor=RGB(122, 122, 122))

# ----
facen = FaceNormals()  # -> Centers, Normals
equals = Equality(FirstNumber=number_slider, SecondNumber=Slider(1, range=0..100))  # -> Equality, Inequality

tstat = TreeStatistics(Tree=f_mvneighf)  # -> Paths, Length, Count

# ----
# Filter Materials by Color
demesh = DeconstructMesh(Mesh=item)  # -> Vertices, Faces, Colours, Normals
lng = ListLength(List=demesh.Colours)
merge = Merge(Data1=swatch, Data2=swatch_2, Data3=swatch_3, Data4=swatch_4, Data5=swatch_5)

# ---- group: Test for Red
test_color = TestColor(BaseListOfColors=demesh.Colours, ColorToTestForInclusion="255,0,0", ColorThreshold=Slider(0.5, range=0..1))
dispatch = Dispatch(List=demesh.Vertices, DispatchPattern=test_color)  # -> ListA, ListB
lng_2 = ListLength(List=dispatch.ListA)

# ---- group: Test for Green
test_color_2 = TestColor(BaseListOfColors=demesh.Colours, ColorToTestForInclusion="0,255,0", ColorThreshold=Slider(0.5, range=0..1))
dispatch_2 = Dispatch(List=demesh.Vertices, DispatchPattern=test_color_2)  # -> ListA, ListB
lng_3 = ListLength(List=dispatch_2.ListA)
pt = Point(dispatch_2.ListA)

# ---- group: Test for Blue
test_color_3 = TestColor(BaseListOfColors=demesh.Colours, ColorToTestForInclusion="0,0,255", ColorThreshold=Slider(0.5, range=0..1))
dispatch_3 = Dispatch(List=demesh.Vertices, DispatchPattern=test_color_3)  # -> ListA, ListB
lng_4 = ListLength(List=dispatch_3.ListA)
pt_2 = Point(dispatch_3.ListA)

# ---- group: Test for Yellow
test_color_4 = TestColor(BaseListOfColors=demesh.Colours, ColorToTestForInclusion="255,255,0", ColorThreshold=Slider(0.488, range=0.3..0.7))
dispatch_4 = Dispatch(List=demesh.Vertices, DispatchPattern=test_color_4)  # -> ListA, ListB
lng_5 = ListLength(List=dispatch_4.ListA)
pt_3 = Point(dispatch_4.ListA)

# ----
# Mission Planner
dispatch_5 = Dispatch(List=demesh.Faces, DispatchPattern=test_color_4)  # -> ListA, ListB
index = ItemIndex(List=demesh.Faces, Item=dispatch_5.ListA)
item_2 = ListItem(List=tstat.Paths, Index=index, Wrap=True)
branch = TreeBranch(Tree=f_mvneighf, Path=item_2, MaintainPaths=True)  # -> flatten(Branch)
sort_2 = SortList(Keys=branch)  # -> Keys, ValuesA
dcon = DeleteConsecutive(Set=sort_2.Keys, Wrap=False)  # -> Set, Count
f_mface = ExtractMeshFace(M=item, I=dcon.Set)  # -> Mf; inputs M: Mesh, I: Int32
# ---------- f_mface: C# ----------
            /*
    froGH - a sparse collection of (in)utilities for Grasshopper

    Extract Mesh Face

    code by Alessio Erioli

    froGH by Co-de-iT is licensed under a Creative Commons Attribution 4.0 International License.
    http://creativecommons.org/licenses/by/4.0/

    */
    initComp();



    Mf = meshFromFace(M, I);
# ---------- f_mface: C# additional code ----------
  void initComp(){
    Component.Name = "Extract Mesh Face";
    Component.NickName = "f_MFace";
    Component.Description = "Extract a Mesh Face (by index) as Mesh";
    Component.Params.Input[0].Name = "Mesh";
    Component.Params.Input[0].Description = "Input Mesh";
    Component.Params.Input[1].Name = "Index";
    Component.Params.Input[1].Description = "Face Index";
    Component.Params.Output[0].Name = "Mesh face";
    Component.Params.Output[0].Description = "face at index I as mesh";
  }

  public Mesh meshFromFace(Mesh M, int i){
    Mesh M1 = new Mesh();
    MeshFace f = M.Faces.GetFace(i);
    if (f.IsValid(M.Vertices.Count)){
      M1.Vertices.Add(M.Vertices[f.A]);
      M1.Vertices.Add(M.Vertices[f.B]);
      M1.Vertices.Add(M.Vertices[f.C]);
      if (f.IsTriangle){
        M1.Faces.AddFace(0, 1, 2);
      }else if (f.IsQuad){
        M1.Vertices.Add(M.Vertices[f.D]);
        M1.Faces.AddFace(0, 1, 2, 3);
      }
    }
    return M1;
  }
# ---------- end f_mface ----------
mjoin = MeshJoin(Meshes=f_mface)
mmerge = MergeMesh(Mesh=mjoin, Flip=False)

# ---- group: Test for Others
merge_2 = Merge(Data1=dispatch.ListA, Data2=dispatch_2.ListA, Data3=dispatch_3.ListA, Data4=dispatch_4.ListA)
lng_6 = ListLength(List=merge_2)

# ----
area = MeshArea(Mesh=mmerge)  # -> Area, Centroid
sort_3 = SortList(Keys=area.Area)  # -> Keys, ValuesA
mcol = MeshColours(Mesh=mmerge, Colours=ColourSwatch(SwatchColor=RGBA(255, 251, 168, 126)))
item_3 = ListItem(List=sort_3.Keys, Index=-1, Wrap=True)
fsim = FindSimilarMember(Data=item_3, Set=area.Area)  # -> Hit, Index
item_4 = ListItem(List=mmerge, Index=fsim.Index, Wrap=True)
wbnaked = WeaverbirdsNakedBoundary(MeshClosedPolylines=item_4)
join = JoinCurves(Curves=wbnaked, Preserve=False)
item_5 = ListItem(List=join, Index=0, Wrap=True)
previewlw = CustomPreviewLineweights(Geometry=join, Shader=ColourSwatch(SwatchColor=RGB(0, 255, 204)), Thickness=Slider(5, range=0..10), Absolute=False)
pline2msh = PolylineToMesh(Polyline=item_5, Quadrangulate=True)
redumsh = ReduceMesh(
    Mesh=pline2msh,
    FaceCount=Slider(100, range=0..100),
    Accuracy=Slider(10, range=0..10),
    FaceType=0,
    Distort=True,
    Normalize=invert(False))  # -> Reduced, CountDifference
explode = MeshExplode(Mesh=redumsh.Reduced, Interpolate=False)

wbnaked_2 = WeaverbirdsNakedBoundary(MeshClosedPolylines=mmerge)
mesh_2 = Mesh(graft(mmerge))
m_conface = ConnectedFaces(M=mesh_2)  # -> out, G, A, T, P
# ---------- m_conface: VB ----------
    Component.Params.Input(0).Name = "Mesh"
    Component.Params.Input(0).Description = "Open or closed mesh"
    Component.Params.Input(1).Name = "Connected Domain"
    Component.Params.Input(1).Description = "The domain that describes the range of connected faces to be tested against"

    Component.Params.Output(1).Name = "Preview Mesh"
    Component.Params.Output(1).Description = "A greyscale preview mesh reflecting the range of values"
    Component.Params.Output(2).Name = "Connections"
    Component.Params.Output(2).Description = "The number of faces connected to each face of the mesh"
    Component.Params.Output(3).Name = "Topology"
    Component.Params.Output(3).Description = "The list of index values connected to the sample point"
    Component.Params.Output(4).Name = "Pattern"
    Component.Params.Output(4).Description = "If the R input is used, the status of each sample point relative to the provided range (0 = Below, 1 = Within, 2 = Above)"

    If M IsNot Nothing Then
      Dim i,j,k,s As Integer

      Dim iP As Grasshopper.Kernel.IGH_Param = Component.Params.Input(0)
      Dim cP As Grasshopper.Kernel.Data.IGH_Structure = iP.VolatileData

      Dim mf As Rhino.Geometry.Collections.MeshFaceList = Nothing
      Dim mfn As Rhino.Geometry.Collections.MeshFaceNormalList = Nothing
      Dim mv As Rhino.Geometry.Collections.MeshVertexList = Nothing
      Dim mtv As Rhino.Geometry.Collections.MeshTopologyVertexList = Nothing
      Dim mte As Rhino.Geometry.Collections.MeshTopologyEdgeList = Nothing
      Dim mn As Rhino.Geometry.Collections.MeshVertexNormalList = Nothing
      Dim mc As Rhino.Geometry.Collections.MeshVertexColorList = Nothing

      mf = m.Faces
      mfn = m.FaceNormals
      mv = m.Vertices
      mtv = m.TopologyVertices
      mte = m.TopologyEdges
      mn = m.Normals
      mc = m.VertexColors

      Dim arrK As New list(Of Integer)
      Dim treeK As New datatree(Of Integer)
      Dim oc As New list(Of color)
      Dim tv,tmin,tmax As Integer
      Dim arrPat As New list(Of Integer)

      Dim mfo As New list(Of MeshFace)
      Dim mvo As New list(Of point3d)

      For i = 0 To mf.count() - 1 Step 1
        Dim tcv() As Integer

        tcv = mf.AdjacentFaces(i)
        s = mvo.count()

        k = (ubound(tcv) + 1)

        If mf.item(i).isquad() Then
          mvo.add(mv.item(mf.item(i).A))
          mvo.add(mv.item(mf.item(i).B))
          mvo.add(mv.item(mf.item(i).C))
          mvo.add(mv.item(mf.item(i).D))
          mfo.add(New meshface(s, s + 1, s + 2, s + 3))
        Else
          mvo.add(mv.item(mf.item(i).A))
          mvo.add(mv.item(mf.item(i).B))
          mvo.add(mv.item(mf.item(i).C))
          mfo.add(New meshface(s, s + 1, s + 2))
        End If

        Dim tang,ang, aMin, aMax As New Double
        For j = 0 To ubound(tcv) Step 1
          treeK.add(tcv(j), cp.Path(Component.RunCount - 1).AppendElement(i))
        Next

        If k < Tmin Then Tmin = k
        If i = 0 Then Tmax = k Else If k > Tmax Then Tmax = k
        arrK.add(k)
      Next

      If R = Nothing Then
        R.t0 = Tmin
        R.t1 = Tmax
      End If

      For i = 0 To mf.count() - 1 Step 1
        If mf.item(i).isquad() Then k = 3 Else k = 2
        If arrK.item(i) < R.T0 Then
          For j = 0 To k Step 1
            oc.add(color.FromArgb(0, 0, 255))
          Next
          arrPat.add(0)
        ElseIf ((arrK.item(i) > R.T1) Or ((R.t0 = 0) And (R.t1 = 0))) Then
          For j = 0 To k Step 1
            oc.add(color.FromArgb(255, 0, 0))
          Next
          arrPat.add(2)
        Else
          For j = 0 To k Step 1
            tv = math.Floor((arrK.item(i) - R.T0) / (R.t1 - R.t0) * 255)
            oc.add(color.FromArgb(tv, tv, tv))
          Next
          arrPat.add(1)
        End If
      Next
      Dim mo As New mesh
      mo.vertices.AddVertices(mvo.toarray())
      mo.Faces.AddFaces(mfo.toarray())
      mo.VertexColors.AppendColors(oc.toarray())

      G = mo
      A = arrK
      P = arrPat
      T = treeK
    End If
# ---------- end m_conface ----------
previewlw_2 = CustomPreviewLineweights(Geometry=wbnaked_2, Shader=ColourSwatch(SwatchColor=RGB(0, 255, 204)), Thickness=Slider(2, range=0..10), Absolute=False)

pt_4 = Point(dispatch.ListA)
subtraction = Subtraction(A=lng, B=lng_6)
division = Division(A=lng_2, B=lng)
division_2 = Division(A=lng_3, B=lng)
division_3 = Division(A=lng_4, B=lng)
division_4 = Division(A=subtraction, B=lng)
division_5 = Division(A=lng_5, B=lng)
multiplication = Multiplication(A=division, B="100")
multiplication_2 = Multiplication(A=division_2, B="100")
multiplication_3 = Multiplication(A=division_3, B="100")
multiplication_4 = Multiplication(A=division_5, B="100")
multiplication_5 = Multiplication(A=division_4, B="100")
custom_round = CustomRound(Numbers=multiplication, Scope="0.1")
custom_round_2 = CustomRound(Numbers=multiplication_2, Scope="0.1")
custom_round_3 = CustomRound(Numbers=multiplication_3, Scope="0.1")
custom_round_4 = CustomRound(Numbers=multiplication_4, Scope="0.1")
custom_round_5 = CustomRound(Numbers=multiplication_5, Scope="0.1")
panel_2 = Panel(custom_round_5)
cn = ClosestNumbers(NumberSet=[lng_2, lng_3, lng_4, lng_5], Search=lng, Count=1)
panel_3 = Panel(cn)
equals_2 = Equality(FirstNumber=cn, SecondNumber=lng_2)  # -> Equality, Inequality
equals_3 = Equality(FirstNumber=cn, SecondNumber=lng_3)  # -> Equality, Inequality
equals_4 = Equality(FirstNumber=cn, SecondNumber=lng_4)  # -> Equality, Inequality
equals_5 = Equality(FirstNumber=cn, SecondNumber=lng_5)  # -> Equality, Inequality
equals_6 = Equality(FirstNumber=cn, SecondNumber=lng_6)  # -> Equality, Inequality
cull = CullPattern(List=merge, CullPattern=[equals_2.Equality, equals_3.Equality, equals_4.Equality, equals_5.Equality, equals_6.Equality])
conmesh = ConstructMesh(Vertices=demesh.Vertices, Faces=demesh.Faces, Colours=cull)

# ---- group: Percentage of Red
panel_4 = Panel(custom_round)

# ---- group: Percentage of Green
panel_5 = Panel(custom_round_2)

# ---- group: Percentage of Blue
panel_6 = Panel(custom_round_3)

# ---- group: Percentage of Yellow
panel_7 = Panel(custom_round_4)

# ----
area_2 = MeshArea(Mesh=explode)  # -> Area, Centroid
extremums = MinMax(Number=area_2.Area)  # -> Minimum, Maximum
multiplication_6 = Multiplication(A=extremums.Maximum, B=extremums.Minimum)
larger = LargerThan(FirstNumber=area_2.Area, SecondNumber=multiplication_6)  # -> LargerThan, OrEqualTo
cull_2 = CullPattern(List=explode, CullPattern=larger.LargerThan)
wbcatmullclark = WeaverbirdsCatmullClarkSubdivision(MeshCurves=cull_2, Level=1, SmoothNakedEdges=2)  # -> flatten(OutputMeshCurves)
index_2 = ItemIndex(List=explode, Item=cull_2)
replace = ReplaceItems(List=explode, Item=wbcatmullclark, Indices=index_2, Wrap=False)
explode_2 = MeshExplode(Mesh=replace, Interpolate=False)  # -> flatten(Faces)

center = Center(Geometry=explode_2)  # -> Center, Dimension
sort_pt = SortPoints(Points=center.Center)  # -> Points, Indices
pline = PolyLine(Vertices=sort_pt.Points, Closed=False)
smoothpline = SmoothPolyline(Polyline=pline, Strength=1, Times=Slider(5, range=0..10))
multiplication_7 = Multiplication(A=Slider(1, range=0..10), B=extremums.Maximum)
reb = RebuildCurve(Curve=smoothpline, Degree=Slider(2, range=0..10), Count=Slider(9, range=0..20), Tangents=False)
divide = DivideCurve(Curve=reb, Count=multiplication_7, Kinks=False)  # -> Points, Tangents, Parameters
move = Move(Geometry=divide.Points, Motion=Vector(0, -5, 0))  # -> Geometry, Transform

rng = RelativeNeighborhood(Points=sort_pt.Points)  # -> flatten(Graph), Indices; disabled
cull_ends = CullEnds(List=sort_pt.Points)  # -> List, Culled
topo = Topologizer(LinesInput=rng.Graph, FixPoints=cull_ends.Culled, Tolerance=Slider(2, range=0..10))  # -> L, P, S, E, N, I, O, G; disabled
cull_ends_2 = CullEnds(List=divide.Points)  # -> List, Culled
pline_2 = PolyLine(Vertices=cull_ends_2.Culled, Closed=False)
shortwalk = ShortestWalk(Curves=topo.L, WantedPath=pline_2)  # -> ShortestWalk, Succession, Direction, Length

entwine = Entwine(Branch00=divide.Points, Branch01=move.Geometry, FlattenInputs=True)

dash = DashPattern(Curve=reb, Pattern=Slider(0.29, range=0..1))  # -> Dashes, Gaps
previewlw_3 = CustomPreviewLineweights(Geometry=dash.Dashes, Shader=ColourSwatch(SwatchColor=RGB(255, 0, 85)), Thickness=Slider(4, range=0..10), Absolute=False)

gate = StreamGate(Data=entwine, PassingSwitch=equals.Equality)
bang = ExplodeTree(Data=gate)  # -> Branch0, Branch1

move_2 = Move(Geometry=bang.Branch1, Motion=Vector(0, -1, 0))  # -> Geometry, Transform
cull_3 = CullPattern(List=move_2.Geometry, CullPattern=[False, True])
tag = TextTag(Location=move_2.Geometry, Text=cull_3, Colour=ColourSwatch(SwatchColor=RGB(255, 255, 255)))
dots = DotDisplay(Point=bang.Branch1, Colour=ColourSwatch(SwatchColor=RGB(0, 255, 170)), Size=Slider(0.2, range=0..1))

dots_2 = DotDisplay(Point=bang.Branch0, Colour=ColourSwatch(SwatchColor=RGB(0, 217, 173)), Size=Slider(0.1, range=0..1))

ln = Line(StartPoint=bang.Branch0, EndPoint=bang.Branch1)
