# Grasshopper definition Material Retrieval.gh (Grasshopper 1.0.7)
# plug-ins: Heteroptera, MeshEdit Components, Volvox, Human UI, Pufferfish, Firefly.X, Topologizer, Human, Parakeet, EleFront, Moonlight, LunchBox, Weaverbird, MetaHopper, Mesh Pipe, Wombat, TT Toolbox, Relative Neighborhood, Shortest Walk in Gh

# ---- group: Position Reading
# Reading values
# from csv file
toggle = BooleanToggle(True)
path = FilePath("D:\Roberto\01 Projects\02 IAAC\02 Curso\Studio II\Week 9\Camera Positions.csv")
readxl = ReadExcelSheet(Run=toggle, FilePath=path, Worksheet="1", Listen=False)  # -> UserMessages, Columns, Rows
# x
item = ListItem(List=readxl.Rows, Index=0, Wrap=True)  # -> flatten(Item)
# y
item_2 = ListItem(List=readxl.Rows, Index=Slider(1, range=0..1), Wrap=True)  # -> flatten(Item)
# z
item_3 = ListItem(List=readxl.Rows, Index=Slider(2, range=0..10), Wrap=True)  # -> flatten(Item)
# rx
item_4 = ListItem(List=readxl.Rows, Index=Slider(3, range=0..10), Wrap=True)  # -> flatten(Item)
# ry
item_5 = ListItem(List=readxl.Rows, Index=Slider(4, range=0..10), Wrap=True)  # -> flatten(Item)
# rz
item_6 = ListItem(List=readxl.Rows, Index=Slider(5, range=0..10), Wrap=True)  # -> flatten(Item)
# xyz
pt = ConstructPoint(XCoordinate=item, YCoordinate=item_2, ZCoordinate=item_3)

# ---- group: Implement Plane Rotation
pl = PlaneNormal(Origin=pt, ZAxis=Vector(0, 0, 1))
# rx
rot3d = Rotate3D(Geometry=pl, Angle=degrees(item_4), Center=pt, Axis=Vector(1, 0, 0))  # -> Geometry, Transform
# rxy
rot3d_2 = Rotate3D(Geometry=rot3d.Geometry, Angle=degrees(item_5), Center=pt, Axis=Vector(0, 1, 0))  # -> Geometry, Transform
# rxyz
rot3d_3 = Rotate3D(Geometry=rot3d_2.Geometry, Angle=degrees(item_6), Center=pt, Axis=Vector(0, 0, 1))  # -> Geometry, Transform

# ---- group: Camera Location
# I
# I
# I
# I
# I
# I
# I
# I
# I
# I
# I
# I
# I
# I
# I
# I
# I
# I
# I
# I
# I
# I
# I
# I
# I
# I
# I
# I
# I
# I
# I
# I
# I
# I
# I
# I
# I
# I
# I
# I
# I
# Planes
number_slider = Slider(90, range=0..360)
rot3d_4 = Rotate3D(Geometry=rot3d_3.Geometry, Angle=degrees(number_slider), Center=Point(0, 0, 0), Axis=Vector(1, 0, 0))  # -> Geometry, Transform
vec = VectorXYZ(XComponent=Slider(1, range=0..100), YComponent=Slider(-21, range=-100..100), ZComponent=Slider(-19, range=-100..100))  # -> Vector, Length
move = Move(Geometry=rot3d_4.Geometry, Motion=vec.Vector)  # -> Geometry, Transform
deplane = DeconstructPlane(Plane=move.Geometry)  # -> Origin, XAxis, YAxis, ZAxis
path_2 = FilePath("D:\Roberto\01 Projects\02 IAAC\02 Curso\Studio II\Week 9\Camera Names.csv")
readxl_2 = ReadExcelSheet(Run=Toggle(True), FilePath=path_2, Worksheet="1", Listen=False)  # -> UserMessages, Columns, flatten(Rows)
number_slider_2 = Slider(7, range=0..100)  # disabled
textdot = DefineTextDot(Text=readxl_2.Rows, Location=deplane.Origin, Font="Arial", Size=number_slider_2)  # disabled

# ----
number_slider_3 = Slider(0.2, range=0..1)  # disabled
msphere = MeshSphere(Base=deplane.Origin, Radius=number_slider_3, UCount=10, VCount=20)  # disabled

# ---- group: Offset Planes for line projection
# I
# I
# I
# I
# I
# I
# I
# I
# I
# I
# I
# I
# I
# I
# I
# I
# I
# I
# I
# I
# I
# I
# I
# I
# I
# I
# I
# I
# I
# I
# I
# I
# I
# I
# I
# I
# I
# I
# I
# I
# I
number_slider_4 = Slider(-0.2, range=-0.2..1)
dom = ConstructDomain(DomainStart=number_slider_4, DomainEnd=Slider(0.2, range=-0.1..1))
number_slider_5 = Slider(4, range=0..10)
pflip = FlipPlane(Plane=move.Geometry, ReverseX=False, ReverseY=False, SwapAxes=True)
planesrf = PlaneSurface(Plane=pflip, XSize=dom, YSize=dom)
mplane = MeshPlane(Boundary=planesrf, WidthCount=number_slider_5, HeightCount=number_slider_5)  # -> Mesh, Area
# Lines for
# collision test
offsetmesh = OffsetMesh(Msh=mplane.Mesh, Dist=Slider(40, range=0..100), C=Toggle(False))  # -> out, M; inputs Msh: Mesh, Dist: list
# ---------- offsetmesh: VB ----------
    '
    'PhylloMachine v1.0
    'Code of OffsetMesh developed by Daniel González Abalde in Spring 2015, released under the GNU 3.0 license, as all files of PhylloMachine.
    'Your are free to modify, copy and derive, but must be subject to this license.
    'Your are free to use the designs made with PhylloMachine for commercial purposes. Consider the option to reward the author, or at least allow to see the product or project.
    'This plugin comes without warranty of any kind, but feel free to contact the author for any PhylloMachine related subject via email to dga_3@hotmail.com. You can also follow his work from facebook.com/DanielAbaldeDesigner
    'Enjoy! ツ
    '
    Component.Params.Input(0).Name = "Mesh"
    Component.Params.Input(0).Description = "Base mesh"
    Component.Params.Input(1).Name = "Distance"
    Component.Params.Input(1).Description = "One value or a list of values to each vertex"
    Component.Params.Input(2).Name = "Close"
    Component.Params.Input(2).Description = "False = Open mesh" & vbCrLf & "True = Close mesh"
    Component.Params.Output(1).Name = "Mesh"
    Component.Params.Output(1).Description = "Resulting mesh"
    '

    If Msh Is Nothing Then Return

    Msh.Normals.ComputeNormals()
    Msh.FaceNormals.ComputeFaceNormals()

    Dim size As Integer = Msh.Vertices.Count

    'Parameters.
    Dim param As New list (Of Double)
    For i As int32 = 0 To size - 1
      param.add(i / (size - 1))
    Next
    '
    'Distances.
    Dim distance As New list(Of Double)
    Dim interp As interpolator = New interpolator(Dist.toArray())
    For Each itc As Double In Param
      Dim valR As Double = interp.InterpolateCubic((Dist.count - 1) * itc)
      distance.add(valR)
    Next
    '
    'Offset mesh.
    Dim omesh As New mesh
    Dim opts As New list(Of point3d)
    For i As int32 = 0 To size - 1
      Dim pt As Point3d = Msh.Vertices(i)
      Dim vec As vector3d = Msh.Normals(i)
      pt = pt + vec * distance(i)
      opts.add(pt)
    Next
    omesh.Vertices.AddVertices(opts)
    omesh.Faces.AddFaces(msh.Faces)
    omesh.Normals.ComputeNormals()
    omesh.FaceNormals.ComputeFaceNormals()
    omesh.VertexColors.SetColors(Msh.VertexColors.ToArray())
    '
    'Build mesh.
    Dim malla As New mesh
    malla.Append(omesh)
    '
    'Naked edges.
    If C Then
      malla.Append(Msh)
      If Not msh.IsClosed() Then

        Dim edges0 As polyline() = msh.GetNakedEdges()
        Dim edges1 As polyline() = omesh.GetNakedEdges()

        Dim avpts0, avpts1 As New list(Of point3d)
        For i As int32 = 0 To edges0.count - 1
          avpts0.add(edges0(i).CenterPoint())
          avpts1.add(edges1(i).CenterPoint())
        Next
        Dim avptslist As New point3dlist(avpts0)
        Dim newidx As New List (Of Integer)
        For i As int32 = 0 To avpts1.count - 1
          Dim idx As Integer = avptslist.ClosestIndex(avpts1(i))
          newidx.add(idx)
        Next
        Dim arridx As Integer() = newidx.toArray()
        array.Sort(arridx, edges1)

        Dim pol0, pol1 As New list(Of polyline)

        For i As int32 = 0 To edges0.count - 1

          Dim c0 As curve = edges0(i).ToNurbsCurve()
          Dim c1 As curve = edges1(i).ToNurbsCurve()

          curve.MakeEndsMeet(c0, True, c1, True)
          Dim ptsl As New point3dlist(edges1(i).ToArray())

          Dim pt0 As point3d = C0.PointAt(0)
          Dim idx As Integer = ptsl.ClosestIndex(pt0)
          Dim pt1 As Point3d = edges1(i).item(idx)
          Dim t1 As New Double
          C1.ClosestPoint(pt1, t1)
          c1.ChangeClosedCurveSeam(t1)
          Dim tst As Boolean = curve.DoDirectionsMatch(c0, c1)
          If tst = False Then
            c1.Reverse()
          End If

          Dim poly0, poly1 As New polyline
          c0.TryGetPolyline(poly0)
          c1.TryGetPolyline(poly1)

          pol0.add(poly0)
          pol1.add(poly1)

        Next

        Dim ptslist As New point3dlist(malla.Vertices.ToPoint3dArray())

        Dim ai, bi, ci, di As  Integer

        For i As int32 = 0 To pol0.count - 1
          Dim lines0 As line() = pol0(i).GetSegments()
          Dim lines1 As line() = pol1(i).GetSegments()
          For j As int32 = 0 To lines0.count - 1
            ai = ptslist.ClosestIndex(lines0(j).From())
            bi = ptslist.ClosestIndex(lines0(j).To())
            di = ptslist.ClosestIndex(lines1(j).From())
            ci = ptslist.ClosestIndex(lines1(j).To())
            malla.Faces.AddFace(New meshface(ai, bi, ci, di))
          Next
        Next
      End If
    End If
    '
    'Refine mesh.
    malla.Compact()
    malla.UnifyNormals()
    malla.Normals.ComputeNormals()
    malla.FaceNormals.ComputeFaceNormals()
    '
    print("IsClosed? " & malla.IsClosed())

    M = malla
# ---------- end offsetmesh ----------
center = Center(Geometry=offsetmesh.M)  # -> Center, Dimension
ln = Line(StartPoint=deplane.Origin, EndPoint=center.Center)

# ----
panel = Panel("""Current State Texture
Materials Gradient
Materials Solid""")
pulldown = CreatePulldownMenu(Label="Styles", ListItems=panel, SelectedIndex="0", showLabel=True)
values = ValueListener(Elements=pulldown, SomeProperty=True)  # -> Values, Indices

# ---- group: Scaled
mesh = Mesh([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])  # disabled

# ----
mesh_2 = Mesh([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])

# ---- group: Updated
mesh_3 = Mesh([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])

# ----
adjustelem = AdjustElementAppearance(ElementsToAdjust=pulldown, FontSize=Slider(22, range=0..100))

# ----
# I
# I
# I
# I
# I
# I
# I
# I
# I
# I
# I
# I
# I
# I
# I
# I
# I
# I
# I
# I
# I
# I
# I
# I
# I
# I
# I
# I
# I
# I
# I
# I
# I
# I
# I
# I
# I
# I
# I
# I
# I
# Visualization UI
# Demolition Process
panel_2 = Panel("Show Demolition Process")
toggle_2 = CreateToggle(Default=False, Label=panel_2, OnLabel="Showing")
values_2 = ValueListener(Elements=toggle_2, SomeProperty=True)  # -> Values, Indices
data = Data([3, 1, 0, 4, 5, 6, 7, 2])
mesh_4 = Mesh([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])
gate = StreamGate(Data=mesh_4, PassingSwitch=values_2.Values)
jitter = Jitter(List=data, Jitter=1, Seed=Slider(28, range=0..50))  # -> Values, Indices
sort = SortList(Keys=jitter.Values, ValuesA=gate)  # -> Keys, simplify(graft(ValuesA))
extremums = MinMax(Number=sort.Keys)  # -> Minimum, Maximum
gradient = Gradient(
    LowerLimit=extremums.Minimum,
    UpperLimit=extremums.Maximum,
    Parameter=sort.Keys,
    stops=[0: RGB(234, 38, 0), 0.185: RGB(234, 126, 0), 0.414: RGB(254, 244, 84), 0.639: RGB(173, 203, 249), 0.857: RGB(75, 107, 169)])
gradient_2 = CreateGradientEditor(GradientS=gradient, ShowEditor=True, ShowPresets=invert(True))
values_3 = ValueListener(Elements=gradient_2, SomeProperty=True)  # -> Values, Indices
mcol = MeshColours(Mesh=sort.ValuesA, Colours=graft(gradient))

# ----
# Point Cloud Tab
panel_3 = Panel("Show Point Cloud")
toggle_3 = CreateToggle(Default=False, Label=panel_3, OnLabel="Showing")
values_4 = ValueListener(Elements=toggle_3, SomeProperty=True)  # -> Values, Indices
clo = Cloud(<cloud referenced from the Rhino model>)
gate_2 = StreamGate(Data=clo, PassingSwitch=values_4.Values)
vsub = VoxelSubsampling(Size=Slider(0.2, range=0..1))  # disabled
cloude = CloudEngine(Cloud=gate_2, Instruction0=vsub)

# ----
# Search Tab
panel_4 = Panel("Materials")
textbox = CreateTextBox(Label=panel_4, DefaultText="Brick Wall", UpdateButton=True, showLabel=True)
adjustelem_2 = AdjustElementAppearance(ElementsToAdjust=textbox, Foreground=ColourSwatch(SwatchColor=RGB(255, 255, 255)), FontSize=Slider(27, range=0..100))
values_5 = ValueListener(Elements=textbox, SomeProperty=True)  # -> Values, Indices
settextbox = SetTextBoxContents(TextBoxToModify=textbox, NewTextBoxContents=values_5.Values)
panel_5 = Panel("""Concrete Beams
Brick Wall
Concrete Floor
Metal Ceiling
Concrete Column
Concrete Column
Concrete Column
Concrete Column""")
fsim = FindSimilarMember(Data=values_5.Values, Set=panel_5)  # -> Hit, Index
cset = CreateSet(List=panel_5)  # -> Set, Map
mindex = MemberIndex(Set=panel_5, Member=cset.Set)  # -> Index, Count
tbi = TreeBranchIndex(DataTree=mindex.Index, BranchIndex=fsim.Index)
panel_6 = Panel(tbi)

# ----
# Test for
# Collision
# Start
# Program
toggle_4 = BooleanToggle(False)
list = ValueList({"Current State Texture": 0, "Materials Gradient": 1, "Materials Solid": 2}, selected="Current State Texture")
mesh_5 = Mesh([<mesh referenced from the Rhino model> x8])
mesh_6 = Mesh([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])
filter = StreamFilter(Gate=values.Indices, Stream0=mesh_5, Stream1=mesh_3, Stream2=mesh_6)
clickm = ClickableMesh(Enable=toggle_4, Meshes=filter)  # -> SelectedMeshes, SelectedIndices, MouseLine
item_7 = ListItem(List=filter, Index=clickm.SelectedIndices, Wrap=True)
item_8 = ListItem(List=filter, Index=fsim.Index, Wrap=True)
filter_2 = StreamFilter(Gate=Toggle(False), Stream0=item_8, Stream1=item_7)
colom = CollisionOneMany(Collider=ln, Obstacles=filter_2)  # -> Collision, Index

index = ItemIndex(List=filter, Item=filter_2)  # -> flatten(Index)

dispatch = Dispatch(List=ln, DispatchPattern=colom.Collision)  # -> ListA, ListB; disabled
line = Line(dispatch.ListA)  # disabled
mcx = MeshCurve(Mesh=mesh_5, Curve=line)  # -> Points, Faces; disabled
previewlw = CustomPreviewLineweights(
    Geometry=line,
    Shader={diffuse=RGB(255, 105, 180), emission=RGB(76, 32, 54), shine=0.5, specular=RGB(255, 255, 255), transparency=0},
    Absolute=False)  # disabled

# ----
# Load Pictures into UI
path_3 = FilePath("D:\Roberto\01 Projects\02 IAAC\02 Curso\Studio II\Week 10\Lowresimages\")
path_4 = FilePath("D:\Roberto\01 Projects\02 IAAC\02 Curso\Studio II\Week 9\output_localization\output_localization\")
dir = DirectoryContents(FolderPath=path_3, Filter="*", IncludeSubfolders=False)  # -> FilePaths, FileNames
dispatch_2 = Dispatch(List=dir.FilePaths, DispatchPattern=colom.Collision)  # -> ListA, ListB
image = CreateImage(ImageSource=dispatch_2.ListA, ImageWidth=300)
dispatch_3 = Dispatch(List=dir.FileNames, DispatchPattern=colom.Collision)  # -> ListA, ListB
label = CreateLabel(LabelText=dispatch_3.ListA, LabelSize=12, Justification=0)
weave = Weave(Pattern=[0, 1], Stream0=image, Stream1=label, NullGaps=False)

# ----
# Load Pictures into UI
path_5 = FilePath("D:\Roberto\01 Projects\02 IAAC\02 Curso\Studio II\Week 10\localization_03_22\LowRes\")
dir_2 = DirectoryContents(FolderPath=path_5, Filter="*", IncludeSubfolders=False)  # -> FilePaths, FileNames
dispatch_4 = Dispatch(List=dir_2.FilePaths, DispatchPattern=colom.Collision)  # -> ListA, ListB
image_2 = CreateImage(ImageSource=dispatch_4.ListA, ImageWidth=300)
dispatch_5 = Dispatch(List=dir_2.FileNames, DispatchPattern=colom.Collision)  # -> ListA, ListB
label_2 = CreateLabel(LabelText=dispatch_5.ListA, LabelSize=12, Justification=0)
weave_2 = Weave(Pattern=[0, 1], Stream0=image_2, Stream1=label_2, NullGaps=False)

# ----
# Visualize Planes
dispatch_6 = Dispatch(List=mplane.Mesh, DispatchPattern=colom.Collision)  # -> ListA, ListB
preview = CustomPreview(Geometry=dispatch_6.ListA, Material=ColourSwatch(SwatchColor=RGB(0, 255, 47)))
preview_2 = CustomPreview(Geometry=dispatch_6.ListB, Material=ColourSwatch(SwatchColor=RGB(255, 0, 0)))

# ---- group: Updated
panel_7 = Panel("""1
0
3
2
4
5
6
7""")
mesh_7 = Mesh([<mesh referenced from the Rhino model> x8])
sort_2 = SortList(Keys=panel_7, ValuesA=mesh_7)  # -> Keys, ValuesA
item_9 = ListItem(List=sort_2.ValuesA, Index=index, Wrap=True)

# ----
f_mvneighf = VertexNeighbourFaces(M=item_9)  # -> nF; inputs M: tree of Mesh
# ---------- f_mvneighf: C# ----------
                /*
    froGH - a sparse collection of (in)utilities for Grasshopper

    Mesh Face Neighbor search - Tree Safe

    code by Alessio Erioli

    This component generates a map of neighbour faces for each vertex
    Works with a single mesh, a list or a tree of meshes

    froGH by Co-de-iT is licensed under a Creative Commons Attribution 4.0 International License.
    http://creativecommons.org/licenses/by/4.0/

    */
    initComp();



    DataTree <int> neighbors = new DataTree<int>();
    Mesh m1;
    GH_Path p;
    int [] neighFaces;
    int[] indArr;
    for (int j = 0; j < M.BranchCount; j++){
      for (int k = 0; k < M.Branch(j).Count; k++){
        m1 = M[M.Paths[j], k];
        for (int i = 0; i < m1.Vertices.Count; i++){
          indArr = M.Paths[j].Indices;
          Array.Resize(ref indArr, indArr.Length + 2);
          indArr[indArr.Length - 2] = k;
          indArr[indArr.Length - 1] = i;
          p = new GH_Path(indArr);
          neighFaces = m1.Vertices.GetVertexFaces(i);
          neighbors.AddRange(neighFaces, p);
        }
      }
    }
    neighbors.SimplifyPaths();
    nF = neighbors;
# ---------- f_mvneighf: C# additional code ----------
  void initComp(){

    Component.Name = "Vertex Neighbour Faces";
    Component.NickName = "f_MVNeighF";
    Component.Description = "generates map of neighbour faces for each vertex";
    Component.Params.Input[0].Name = "Mesh";
    Component.Params.Input[0].Description = "Input Mesh(es)";
    Component.Params.Output[0].Name = "neighbour faces indexes";
    Component.Params.Output[0].Description = "indexes of neighbour faces for each vertex";
  }
# ---------- end f_mvneighf ----------

# ----
# Data Frame
panel_8 = Panel("""Beams
Wall
Floor
Ceiling
Column
Column
Column
Column""")
item_10 = ListItem(List=panel_8, Index=index, Wrap=True)
lng = ListLength(List=dispatch_5.ListA)
dispatch_7 = Dispatch(List=pflip, DispatchPattern=colom.Collision)  # -> ListA, ListB
repeat = RepeatData(Data=item_10, Length=lng)
entwine = Entwine(Branch0X=dispatch_5.ListA, Branch1X=dispatch_7.ListA, Branch2X=repeat, FlattenInputs=False)  # -> simplify(Result)
panel_9 = Panel("""Camera Names
Planes
Element""")
panel_10 = Panel(entwine)
datatable = CreateDataTable(Data=entwine, ColumnHeadings=panel_9, AllowSorting=True, ColumnSizingMode=-1)

setscribble = SetScribbleProperties(
    Scribble=["Grasshopper.Kernel.Types.GH_ObjectWrapper", "Grasshopper.Kernel.Types.GH_ObjectWrapper", "Grasshopper.Kernel.Types.GH_ObjectWrapper", "Grasshopper.Kernel.Types.GH_ObjectWrapper", "Grasshopper.Kernel.Types.GH_ObjectWrapper", "Grasshopper.Kernel.Types.GH_ObjectWrapper", "Grasshopper.Kernel.Types.GH_ObjectWrapper", "Grasshopper.Kernel.Types.GH_ObjectWrapper", "Grasshopper.Kernel.Types.GH_ObjectWrapper", "Grasshopper.Kernel.Types.GH_ObjectWrapper", "Grasshopper.Kernel.Types.GH_ObjectWrapper", "Grasshopper.Kernel.Types.GH_ObjectWrapper", "Grasshopper.Kernel.Types.GH_ObjectWrapper", "Grasshopper.Kernel.Types.GH_ObjectWrapper", "Grasshopper.Kernel.Types.GH_ObjectWrapper", "Grasshopper.Kernel.Types.GH_ObjectWrapper", "Grasshopper.Kernel.Types.GH_ObjectWrapper", "Grasshopper.Kernel.Types.GH_ObjectWrapper", "Grasshopper.Kernel.Types.GH_ObjectWrapper", "Grasshopper.Kernel.Types.GH_ObjectWrapper", "Grasshopper.Kernel.Types.GH_ObjectWrapper", "Grasshopper.Kernel.Types.GH_ObjectWrapper", "Grasshopper.Kernel.Types.GH_ObjectWrapper", "Grasshopper.Kernel.Types.GH_ObjectWrapper"],
    ScribbleSize=Slider(24, range=0..100),
    ScribbleFont="Brandon")

panel_11 = Panel(mindex.Index)
moonlight = Moonlight(Mode=invert(False))
item_11 = ListItem(List=sort_2.ValuesA, Index=tbi, Wrap=True)

# ---- group: Bricks
swatch = ColourSwatch(SwatchColor=RGB(191, 0, 0))

# ---- group: Metal
swatch_2 = ColourSwatch(SwatchColor=RGB(5, 204, 2))

# ---- group: Concrete
swatch_3 = ColourSwatch(SwatchColor=RGB(0, 25, 214))

# ---- group: Wood
swatch_4 = ColourSwatch(SwatchColor=RGB(222, 211, 0))

# ---- group: Others
swatch_5 = ColourSwatch(SwatchColor=RGB(122, 122, 122))

# ----
facen = FaceNormals()  # -> Centers, Normals
equals = Equality(FirstNumber=fsim.Index, SecondNumber=Slider(1, range=0..100))  # -> Equality, Inequality

mesh_topology = MeshTopology(BaseMesh=item_9)  # -> Vertices, Edges, Faces, PointPointTopology, PointLineTopology, PointFaceTopology, LinePointTopology, LineLineTopology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; disabled
tstat = TreeStatistics(Tree=f_mvneighf)  # -> Paths, Length, Count

# ----
# Filter Materials by Color
# Scaled
mesh_8 = Mesh([<mesh referenced from the Rhino model> x8])
mesh_9 = Mesh([<mesh referenced from the Rhino model> x8])  # disabled
panel_12 = Panel("""3
1
2
0
7
6
5
4""")
sort_3 = SortList(Keys=panel_12, ValuesA=mesh_8)  # -> Keys, ValuesA
item_12 = ListItem(List=sort_3.ValuesA, Index=index, Wrap=True)
demesh = DeconstructMesh(Mesh=item_9)  # -> Vertices, Faces, Colours, Normals
lng_2 = ListLength(List=demesh.Colours)
merge = Merge(Data1=swatch, Data2=swatch_2, Data3=swatch_3, Data4=swatch_4, Data5=swatch_5)

# ---- group: Test for Red
test_color = TestColor(BaseListOfColors=demesh.Colours, ColorToTestForInclusion="255,0,0", ColorThreshold=Slider(0.5, range=0..1))
dispatch_8 = Dispatch(List=demesh.Vertices, DispatchPattern=test_color)  # -> ListA, ListB
lng_3 = ListLength(List=dispatch_8.ListA)

# ---- group: Test for Green
test_color_2 = TestColor(BaseListOfColors=demesh.Colours, ColorToTestForInclusion="0,255,0", ColorThreshold=Slider(0.5, range=0..1))
dispatch_9 = Dispatch(List=demesh.Vertices, DispatchPattern=test_color_2)  # -> ListA, ListB
lng_4 = ListLength(List=dispatch_9.ListA)
pt_2 = Point(dispatch_9.ListA)

# ---- group: Test for Blue
test_color_3 = TestColor(BaseListOfColors=demesh.Colours, ColorToTestForInclusion="0,0,255", ColorThreshold=Slider(0.5, range=0..1))
dispatch_10 = Dispatch(List=demesh.Vertices, DispatchPattern=test_color_3)  # -> ListA, ListB
lng_5 = ListLength(List=dispatch_10.ListA)
pt_3 = Point(dispatch_10.ListA)

# ---- group: Test for Yellow
test_color_4 = TestColor(BaseListOfColors=demesh.Colours, ColorToTestForInclusion="255,255,0", ColorThreshold=Slider(0.488, range=0.3..0.7))
dispatch_11 = Dispatch(List=demesh.Vertices, DispatchPattern=test_color_4)  # -> ListA, ListB
lng_6 = ListLength(List=dispatch_11.ListA)
pt_4 = Point(dispatch_11.ListA)

# ----
# Mission Planner
dispatch_12 = Dispatch(List=demesh.Faces, DispatchPattern=test_color_4)  # -> ListA, ListB
index_2 = ItemIndex(List=demesh.Faces, Item=dispatch_12.ListA)
item_13 = ListItem(List=tstat.Paths, Index=index_2, Wrap=True)
branch = TreeBranch(Tree=f_mvneighf, Path=item_13, MaintainPaths=True)  # -> flatten(Branch)
sort_4 = SortList(Keys=branch)  # -> Keys, ValuesA
dcon = DeleteConsecutive(Set=sort_4.Keys, Wrap=False)  # -> Set, Count
f_mface = ExtractMeshFace(M=item_9, I=dcon.Set)  # -> Mf; inputs M: Mesh, I: Int32
# ---------- f_mface: C# ----------
            /*
    froGH - a sparse collection of (in)utilities for Grasshopper

    Extract Mesh Face

    code by Alessio Erioli

    froGH by Co-de-iT is licensed under a Creative Commons Attribution 4.0 International License.
    http://creativecommons.org/licenses/by/4.0/

    */
    initComp();



    Mf = meshFromFace(M, I);
# ---------- f_mface: C# additional code ----------
  void initComp(){
    Component.Name = "Extract Mesh Face";
    Component.NickName = "f_MFace";
    Component.Description = "Extract a Mesh Face (by index) as Mesh";
    Component.Params.Input[0].Name = "Mesh";
    Component.Params.Input[0].Description = "Input Mesh";
    Component.Params.Input[1].Name = "Index";
    Component.Params.Input[1].Description = "Face Index";
    Component.Params.Output[0].Name = "Mesh face";
    Component.Params.Output[0].Description = "face at index I as mesh";
  }

  public Mesh meshFromFace(Mesh M, int i){
    Mesh M1 = new Mesh();
    MeshFace f = M.Faces.GetFace(i);
    if (f.IsValid(M.Vertices.Count)){
      M1.Vertices.Add(M.Vertices[f.A]);
      M1.Vertices.Add(M.Vertices[f.B]);
      M1.Vertices.Add(M.Vertices[f.C]);
      if (f.IsTriangle){
        M1.Faces.AddFace(0, 1, 2);
      }else if (f.IsQuad){
        M1.Vertices.Add(M.Vertices[f.D]);
        M1.Faces.AddFace(0, 1, 2, 3);
      }
    }
    return M1;
  }
# ---------- end f_mface ----------
mjoin = MeshJoin(Meshes=f_mface)
mmerge = MergeMesh(Mesh=mjoin, Flip=False)

# ---- group: Test for Others
merge_2 = Merge(Data1=dispatch_8.ListA, Data2=dispatch_9.ListA, Data3=dispatch_10.ListA, Data4=dispatch_11.ListA)
lng_7 = ListLength(List=merge_2)

# ----
area = MeshArea(Mesh=mmerge)  # -> Area, Centroid
sort_5 = SortList(Keys=area.Area)  # -> Keys, ValuesA
mcol_2 = MeshColours(Mesh=mmerge, Colours=ColourSwatch(SwatchColor=RGBA(255, 251, 168, 126)))
item_14 = ListItem(List=sort_5.Keys, Index=-1, Wrap=True)
fsim_2 = FindSimilarMember(Data=item_14, Set=area.Area)  # -> Hit, Index
item_15 = ListItem(List=mmerge, Index=fsim_2.Index, Wrap=True)
wbnaked = WeaverbirdsNakedBoundary(MeshClosedPolylines=item_15)
join = JoinCurves(Curves=wbnaked, Preserve=False)
item_16 = ListItem(List=join, Index=0, Wrap=True)
previewlw_2 = CustomPreviewLineweights(Geometry=join, Shader=ColourSwatch(SwatchColor=RGB(0, 255, 204)), Thickness=Slider(5, range=0..10), Absolute=False)
pline2msh = PolylineToMesh(Polyline=item_16, Quadrangulate=True)
redumsh = ReduceMesh(
    Mesh=pline2msh,
    FaceCount=Slider(100, range=0..100),
    Accuracy=Slider(10, range=0..10),
    FaceType=0,
    Distort=True,
    Normalize=invert(False))  # -> Reduced, CountDifference
explode = MeshExplode(Mesh=redumsh.Reduced, Interpolate=False)

wbnaked_2 = WeaverbirdsNakedBoundary(MeshClosedPolylines=mmerge)
mesh_10 = Mesh(graft(mmerge))
m_conface = ConnectedFaces(M=mesh_10)  # -> out, G, A, T, P
# ---------- m_conface: VB ----------
    Component.Params.Input(0).Name = "Mesh"
    Component.Params.Input(0).Description = "Open or closed mesh"
    Component.Params.Input(1).Name = "Connected Domain"
    Component.Params.Input(1).Description = "The domain that describes the range of connected faces to be tested against"

    Component.Params.Output(1).Name = "Preview Mesh"
    Component.Params.Output(1).Description = "A greyscale preview mesh reflecting the range of values"
    Component.Params.Output(2).Name = "Connections"
    Component.Params.Output(2).Description = "The number of faces connected to each face of the mesh"
    Component.Params.Output(3).Name = "Topology"
    Component.Params.Output(3).Description = "The list of index values connected to the sample point"
    Component.Params.Output(4).Name = "Pattern"
    Component.Params.Output(4).Description = "If the R input is used, the status of each sample point relative to the provided range (0 = Below, 1 = Within, 2 = Above)"

    If M IsNot Nothing Then
      Dim i,j,k,s As Integer

      Dim iP As Grasshopper.Kernel.IGH_Param = Component.Params.Input(0)
      Dim cP As Grasshopper.Kernel.Data.IGH_Structure = iP.VolatileData

      Dim mf As Rhino.Geometry.Collections.MeshFaceList = Nothing
      Dim mfn As Rhino.Geometry.Collections.MeshFaceNormalList = Nothing
      Dim mv As Rhino.Geometry.Collections.MeshVertexList = Nothing
      Dim mtv As Rhino.Geometry.Collections.MeshTopologyVertexList = Nothing
      Dim mte As Rhino.Geometry.Collections.MeshTopologyEdgeList = Nothing
      Dim mn As Rhino.Geometry.Collections.MeshVertexNormalList = Nothing
      Dim mc As Rhino.Geometry.Collections.MeshVertexColorList = Nothing

      mf = m.Faces
      mfn = m.FaceNormals
      mv = m.Vertices
      mtv = m.TopologyVertices
      mte = m.TopologyEdges
      mn = m.Normals
      mc = m.VertexColors

      Dim arrK As New list(Of Integer)
      Dim treeK As New datatree(Of Integer)
      Dim oc As New list(Of color)
      Dim tv,tmin,tmax As Integer
      Dim arrPat As New list(Of Integer)

      Dim mfo As New list(Of MeshFace)
      Dim mvo As New list(Of point3d)

      For i = 0 To mf.count() - 1 Step 1
        Dim tcv() As Integer

        tcv = mf.AdjacentFaces(i)
        s = mvo.count()

        k = (ubound(tcv) + 1)

        If mf.item(i).isquad() Then
          mvo.add(mv.item(mf.item(i).A))
          mvo.add(mv.item(mf.item(i).B))
          mvo.add(mv.item(mf.item(i).C))
          mvo.add(mv.item(mf.item(i).D))
          mfo.add(New meshface(s, s + 1, s + 2, s + 3))
        Else
          mvo.add(mv.item(mf.item(i).A))
          mvo.add(mv.item(mf.item(i).B))
          mvo.add(mv.item(mf.item(i).C))
          mfo.add(New meshface(s, s + 1, s + 2))
        End If

        Dim tang,ang, aMin, aMax As New Double
        For j = 0 To ubound(tcv) Step 1
          treeK.add(tcv(j), cp.Path(Component.RunCount - 1).AppendElement(i))
        Next

        If k < Tmin Then Tmin = k
        If i = 0 Then Tmax = k Else If k > Tmax Then Tmax = k
        arrK.add(k)
      Next

      If R = Nothing Then
        R.t0 = Tmin
        R.t1 = Tmax
      End If

      For i = 0 To mf.count() - 1 Step 1
        If mf.item(i).isquad() Then k = 3 Else k = 2
        If arrK.item(i) < R.T0 Then
          For j = 0 To k Step 1
            oc.add(color.FromArgb(0, 0, 255))
          Next
          arrPat.add(0)
        ElseIf ((arrK.item(i) > R.T1) Or ((R.t0 = 0) And (R.t1 = 0))) Then
          For j = 0 To k Step 1
            oc.add(color.FromArgb(255, 0, 0))
          Next
          arrPat.add(2)
        Else
          For j = 0 To k Step 1
            tv = math.Floor((arrK.item(i) - R.T0) / (R.t1 - R.t0) * 255)
            oc.add(color.FromArgb(tv, tv, tv))
          Next
          arrPat.add(1)
        End If
      Next
      Dim mo As New mesh
      mo.vertices.AddVertices(mvo.toarray())
      mo.Faces.AddFaces(mfo.toarray())
      mo.VertexColors.AppendColors(oc.toarray())

      G = mo
      A = arrK
      P = arrPat
      T = treeK
    End If
# ---------- end m_conface ----------
previewlw_3 = CustomPreviewLineweights(Geometry=wbnaked_2, Shader=ColourSwatch(SwatchColor=RGB(0, 255, 204)), Thickness=Slider(2, range=0..10), Absolute=False)

pt_5 = Point(dispatch_8.ListA)
subtraction = Subtraction(A=lng_2, B=lng_7)
division = Division(A=lng_3, B=lng_2)
division_2 = Division(A=lng_4, B=lng_2)
division_3 = Division(A=lng_5, B=lng_2)
division_4 = Division(A=subtraction, B=lng_2)
division_5 = Division(A=lng_6, B=lng_2)
multiplication = Multiplication(A=division, B="100")
multiplication_2 = Multiplication(A=division_2, B="100")
multiplication_3 = Multiplication(A=division_3, B="100")
multiplication_4 = Multiplication(A=division_5, B="100")
multiplication_5 = Multiplication(A=division_4, B="100")
custom_round = CustomRound(Numbers=multiplication, Scope="0.1")
custom_round_2 = CustomRound(Numbers=multiplication_2, Scope="0.1")
custom_round_3 = CustomRound(Numbers=multiplication_3, Scope="0.1")
custom_round_4 = CustomRound(Numbers=multiplication_4, Scope="0.1")
custom_round_5 = CustomRound(Numbers=multiplication_5, Scope="0.1")
panel_13 = Panel(custom_round_5)
cn = ClosestNumbers(NumberSet=[lng_3, lng_4, lng_5, lng_6], Search=lng_2, Count=1)
panel_14 = Panel(cn)
equals_2 = Equality(FirstNumber=cn, SecondNumber=lng_3)  # -> Equality, Inequality
equals_3 = Equality(FirstNumber=cn, SecondNumber=lng_4)  # -> Equality, Inequality
equals_4 = Equality(FirstNumber=cn, SecondNumber=lng_5)  # -> Equality, Inequality
equals_5 = Equality(FirstNumber=cn, SecondNumber=lng_6)  # -> Equality, Inequality
equals_6 = Equality(FirstNumber=cn, SecondNumber=lng_7)  # -> Equality, Inequality
cull = CullPattern(List=merge, CullPattern=[equals_2.Equality, equals_3.Equality, equals_4.Equality, equals_5.Equality, equals_6.Equality])
conmesh = ConstructMesh(Vertices=demesh.Vertices, Faces=demesh.Faces, Colours=cull)

# ---- group: Percentage of Red
panel_15 = Panel(custom_round)

# ---- group: Percentage of Green
panel_16 = Panel(custom_round_2)

# ---- group: Percentage of Blue
panel_17 = Panel(custom_round_3)

# ---- group: Percentage of Yellow
panel_18 = Panel(custom_round_4)

# ----
data_2 = Data([custom_round, custom_round_2, custom_round_3, custom_round_4, custom_round_5])
cn_2 = ClosestNumbers(NumberSet=data_2, Search="100", Count=5)
mindex_2 = MemberIndex(Set=data_2, Member=cn_2)  # -> flatten(Index), Count

# ----
# 3D View
number_slider_6 = Slider(332, range=0..1000)
_3dview = Create3DView(MeshToDisplay=item_11, MeshColors=cull, ViewWidth=number_slider_6, ViewHeight=300)
pt_6 = Point(<point referenced from the Rhino model>)
pt_7 = Point(<point referenced from the Rhino model>)
set3dviewprops = Set3DViewProperties(_3DView=_3dview, ShowViewCube=Toggle(False), PerspectiveParallel=Toggle(True), CameraLocation=pt_6, CameraTarget=pt_7)

area_2 = MeshArea(Mesh=explode)  # -> Area, Centroid
extremums_2 = MinMax(Number=area_2.Area)  # -> Minimum, Maximum
multiplication_6 = Multiplication(A=extremums_2.Maximum, B=extremums_2.Minimum)
larger = LargerThan(FirstNumber=area_2.Area, SecondNumber=multiplication_6)  # -> LargerThan, OrEqualTo
cull_2 = CullPattern(List=explode, CullPattern=larger.LargerThan)
wbcatmullclark = WeaverbirdsCatmullClarkSubdivision(MeshCurves=cull_2, Level=1, SmoothNakedEdges=2)  # -> flatten(OutputMeshCurves)
index_3 = ItemIndex(List=explode, Item=cull_2)
replace = ReplaceItems(List=explode, Item=wbcatmullclark, Indices=index_3, Wrap=False)
explode_2 = MeshExplode(Mesh=replace, Interpolate=False)  # -> flatten(Faces)

item_17 = ListItem(List=[swatch, swatch_2, swatch_3, swatch_4, swatch_5], Index=mindex_2.Index, Wrap=True)

# ----
# Search Panel
# Window
panel_19 = Panel("Search Panel")

launchwin = LaunchWindow(
    Show=toggle_4,
    Name=panel_19,
    Width=370,
    Height="800",
    FontFamily="Brandon Grotesque",
    ChildStatus=0,
    EnableHorizScroll=False)

addelems = AddElements(Window=launchwin, Elements=flatten([textbox, pulldown, toggle_3, toggle_2, datatable, gradient_2]), DoVLChecking=True)  # -> AddedElements, ElementNames

# ----
# Area per Surface
area_3 = Area(Geometry=item_9)  # -> Area, Centroid
panel_20 = Panel("""Beams
Wall
Floor
Ceiling
Columns
Columns
Columns
Columns""")
item_18 = ListItem(List=panel_20, Index=index, Wrap=True)

division_6 = Division(A=area_3.Area, B=Slider(7.25, range=0..10))

round = Round(Number=division_6)  # -> Nearest, Floor, Ceiling
concat = Concatenate(FragmentD=item_18, FragmentA=" Area: ", FragmentB=round.Nearest, FragmentC="m2")
tb = CreateTextBlock(Text=concat, TextSize=16, Justification=0)

# ----
# Amount of bricks
equals_7 = Equality(FirstNumber=index, SecondNumber=1)  # -> Equality, Inequality
multiplication_7 = Multiplication(A=round.Nearest, B="60")
concat_2 = Concatenate(FragmentD="Amount of Bricks: ", FragmentA=multiplication_7)
gate_3 = StreamGate(Data=concat_2, PassingSwitch=equals_7.Equality)
tb_2 = CreateTextBlock(Text=gate_3, TextSize=16, Justification=0)

adjustelem_3 = AdjustElementAppearance(ElementsToAdjust=tb, Foreground=ColourSwatch(SwatchColor=RGB(201, 201, 201)), FontSize=Slider(23, range=0..100))
adjustelem_4 = AdjustElementAppearance(ElementsToAdjust=tb_2, Foreground=ColourSwatch(SwatchColor=RGB(219, 219, 219)))

# ----
# Material Chart
panel_21 = Panel("""Bricks
Metal
Concrete
Wood
Other""")

item_19 = ListItem(List=panel_21, Index=mindex_2.Index, Wrap=True)

chart = CreateChart(Data=cn_2, Names=item_19, Title="% Material on Element", ChartType=1)
chartappearance = ChartAppearance(ChartToModify=chart, Colors=item_17, Legend=Toggle(True))

adjustelem_5 = AdjustElementAppearance(ElementsToAdjust=chart, Background=ColourSwatch(SwatchColor=RGB(38, 38, 38)))
entwine_2 = Entwine(Branch00=chart, Branch01=_3dview, Branch02=tb, Branch03=tb_2, FlattenInputs=True)  # -> flatten(Result)

# ----
# Material Report
lng_8 = ListLength(List=dispatch_5.ListA)
objdet = ObjectDetails(Object=filter_2)  # -> Referenced, Available, Name, Layer, Colour, Guid
item_20 = ListItem(List=item_19, Index=0, Wrap=True)
repeat_2 = RepeatData(Data=objdet.Guid, Length=lng_8)
repeat_3 = RepeatData(Data=item_20, Length=lng_8)
values_6 = ValueListener(Elements=label_2, SomeProperty=True)  # -> flatten(Values), Indices
values_7 = ValueListener(Elements=image_2, SomeProperty=True)  # -> flatten(Values), Indices
item_21 = ListItem(List=cn_2, Index=0, Wrap=True)
data_3 = Data(round.Nearest)
repeat_4 = RepeatData(Data=item_21, Length=lng_8)
repeat_5 = RepeatData(Data=data_3, Length=lng_8)
division_7 = Division(A=item_21, B="100")
multiplication_8 = Multiplication(A=division_7, B=data_3)
repeat_6 = RepeatData(Data=multiplication_8, Length=lng_8)
entwine_3 = Entwine(
    Branch00=values_6.Values,
    Branch01=values_7.Values,
    Branch02=dispatch_7.ListA,
    Branch03=repeat,
    Branch04=repeat_5,
    Branch05=repeat_2,
    Branch06=repeat_3,
    Branch07=repeat_4,
    Branch08=repeat_6,
    FlattenInputs=True)
panel_22 = Panel("""Camera Names
File Location
Planes Positions
Element Name
Element Area (m2)
Element ID
Material
% Material in Element
Material Area (m2)""")  # disabled
toggle_5 = BooleanToggle(False)  # disabled
csv = CreateCSV(DataGridHeaders=panel_22, ValueTree=entwine_3, Delimiter=",")  # disabled
writexl = WriteToExcel(
    Run=toggle_5,
    ExcelWorksheet="1",
    ColumnNames=panel_22,
    WriteOptions="None",
    ColumnnsOrRows=invert(True),
    DataToWriteIntoColumns=entwine_3)  # disabled

# ----
# Control Panel
panel_23 = Panel("DATA")
tabs = TabbedView(
    TabNames=[panel_23, "IMAGES", "LOCALIZATION"],
    TabTextSize="22",
    Tab0=flatten(entwine_2),
    Tab1=flatten(weave),
    Tab2=flatten(weave_2))

launchwin_2 = LaunchWindow(
    Show=toggle_4,
    Name="Control Panel",
    Width=370,
    Height="800",
    FontFamily="Brandon Grotesque",
    ChildStatus=0,
    EnableHorizScroll=False)

addelems_2 = AddElements(Window=launchwin_2, Elements=flatten(tabs), DoVLChecking=True)  # -> AddedElements, ElementNames

winprops = SetWindowProperties(Window=[launchwin, launchwin_2], Theme=1, AccentColor="magenta", ShowTitleBar=True, ScaleFactor=1)

center_2 = Center(Geometry=explode_2)  # -> Center, Dimension
sort_pt = SortPoints(Points=center_2.Center)  # -> Points, Indices
pline = PolyLine(Vertices=sort_pt.Points, Closed=False)
smoothpline = SmoothPolyline(Polyline=pline, Strength=1, Times=Slider(5, range=0..10))
multiplication_9 = Multiplication(A=Slider(1, range=0..10), B=extremums_2.Maximum)
reb = RebuildCurve(Curve=smoothpline, Degree=Slider(2, range=0..10), Count=Slider(9, range=0..20), Tangents=False)
divide = DivideCurve(Curve=reb, Count=multiplication_9, Kinks=False)  # -> Points, Tangents, Parameters
move_2 = Move(Geometry=divide.Points, Motion=Vector(0, -5, 0))  # -> Geometry, Transform

rng = RelativeNeighborhood(Points=sort_pt.Points)  # -> flatten(Graph), Indices; disabled
cull_ends = CullEnds(List=sort_pt.Points)  # -> List, Culled
topo = Topologizer(LinesInput=rng.Graph, FixPoints=cull_ends.Culled, Tolerance=Slider(2, range=0..10))  # -> L, P, S, E, N, I, O, G; disabled
cull_ends_2 = CullEnds(List=divide.Points)  # -> List, Culled
pline_2 = PolyLine(Vertices=cull_ends_2.Culled, Closed=False)
shortwalk = ShortestWalk(Curves=topo.L, WantedPath=pline_2)  # -> ShortestWalk, Succession, Direction, Length

entwine_4 = Entwine(Branch00=divide.Points, Branch01=move_2.Geometry, FlattenInputs=True)

dash = DashPattern(Curve=reb, Pattern=Slider(0.29, range=0..1))  # -> Dashes, Gaps
previewlw_4 = CustomPreviewLineweights(Geometry=dash.Dashes, Shader=ColourSwatch(SwatchColor=RGB(255, 0, 85)), Thickness=Slider(4, range=0..10), Absolute=False)

gate_4 = StreamGate(Data=entwine_4, PassingSwitch=equals.Equality)
bang = ExplodeTree(Data=gate_4)  # -> Branch0, Branch1

move_3 = Move(Geometry=bang.Branch1, Motion=Vector(0, -1, 0))  # -> Geometry, Transform
cull_3 = CullPattern(List=move_3.Geometry, CullPattern=[False, True])
tag = TextTag(Location=move_3.Geometry, Text=cull_3, Colour=ColourSwatch(SwatchColor=RGB(255, 255, 255)))
dots = DotDisplay(Point=bang.Branch1, Colour=ColourSwatch(SwatchColor=RGB(0, 255, 170)), Size=Slider(0.2, range=0..1))

dots_2 = DotDisplay(Point=bang.Branch0, Colour=ColourSwatch(SwatchColor=RGB(0, 217, 173)), Size=Slider(0.1, range=0..1))

ln_2 = Line(StartPoint=bang.Branch0, EndPoint=bang.Branch1)
